# Grasshopper definition DDU_CSC_GrasshopperInterface_Example_07.gh (Grasshopper 1.0.8)
# Copyright: 2025

# ---- group: __DDU_CSC_EXAMPLE_07__
# Step 1.1
# comments & notes: Here we convert a lat/lon string to a location vector. You can get lat/lon from Google Maps (or similar services).
# 
# If you're at DDU, just leave it as it is. The pre-set value is the location of the DDU lab.
latitude_longitude_string_i_e_from_googl = Panel("49.861444, 8.676556")  # "Latitude/Longitude String (i.e. from Google Maps)"
convertgeolocation = ConvertGeoLocation(LatLonString=latitude_longitude_string_i_e_from_googl)  # -> Lat, Lon, Vec; inputs LatLonString: String
# ---------- convertgeolocation: Python ----------
#! python3
# -*- coding: utf-8 -*-
# venv: DDU_CSC
print('ENV OK!')
# r: charset_normalizer
# r: requests

# RHINO AND GH RELATED IMPORTS ------------------------------------------------
import System  # NOQA
import Grasshopper  # NOQA
import Rhino  # NOQA
import scriptcontext as sc  # NOQA

# GHENV COMPONENT SETTINGS ----------------------------------------------------
ghenv.Component.Name = 'ConvertGeoLocation'  # NOQA
ghenv.Component.NickName = 'ConvertGeoLocation'  # NOQA
ghenv.Component.Category = 'DDU_CSC'  # NOQA
ghenv.Component.SubCategory = '6 Data Tools'  # NOQA
ghenv.Component.Description = (  # NOQA
    'Converts a latitude, longitude string (i.e. from Google Maps) '
    'to its individual components. Example input: "12.1231321, 9.1231231312" '
    'Returns the location as individual numbers and as vector.'
)

# OPTIONAL HELPERS: they never block the component (decisions 8.112, 8.113) ---
try:
    from csc_gh.ports import ensure_outputs
    from csc_gh.messages import set_state
except ImportError:
    ensure_outputs = set_state = None

OUTPUTS = [
    ('Lat', 'Lat',
     'Latitude component of the input string as float.'),
    ('Lon', 'Lon',
     'Longitude component of the input string as float.'),
    ('Vec', 'Vec',
     'Vector with lat/lon as X/Y.'),
]


def empty_outputs():
    """What RunScript returns when it stops early."""
    if len(OUTPUTS) <= 1:
        return None
    return tuple(None for _ in OUTPUTS)


class CSC_ConvertGeoLocation(Grasshopper.Kernel.GH_ScriptInstance):
    """
    Author: Max Benjamin Eschenbach
    License: MIT License
    Version: 261005
    """

    _outputs_ready = True       # set by BeforeRunScript (8.112)
    _outputs_note = None

    def __init__(self):
        """Initialize this component and set component parameters."""
        super().__init__()
        # initialize props
        self.Component = ghenv.Component  # NOQA
        self.InputParams = self.Component.Params.Input
        self.OutputParams = self.Component.Params.Output

    def _addRemark(self, msg: str = ''):
        """Add a remark message to the component."""
        rml = self.Component.RuntimeMessageLevel.Remark
        self.AddRuntimeMessage(rml, msg)

    def _addWarning(self, msg: str = ''):
        """Add a warning message to the component."""
        rml = self.Component.RuntimeMessageLevel.Warning
        self.AddRuntimeMessage(rml, msg)

    def _addError(self, msg: str = ''):
        """Add an error message to the component."""
        rml = self.Component.RuntimeMessageLevel.Error
        self.AddRuntimeMessage(rml, msg)

    def _state(self, text=''):
        """The one short state under the component (decision 8.113)."""
        if set_state is not None:
            set_state(self.Component, text)

    def _stop(self):
        """True when RunScript has to return early: the outputs were just
        updated (says why)."""
        if self._outputs_note:
            self._addRemark(self._outputs_note)
        return not self._outputs_ready

    def _check_outputs(self):
        """Make the outputs match OUTPUTS before the script runs (8.112)."""
        self._outputs_ready, self._outputs_note = True, None
        if ensure_outputs is None:
            self._outputs_note = (
                'output check skipped: CSC library not installed')
            return
        status = ensure_outputs(self.Component, OUTPUTS)
        self._outputs_ready, self._outputs_note = status.ready, status.remark

    def BeforeRunScript(self):
        """Perform some setup actions."""
        # Initialize input param descriptions
        self.InputParams[0].Description = (
            'Latitude, Longitude string, e.g. "12.1231321, 9.1231231312" '
        )
        # Initialize output param descriptions
        self._check_outputs()

    def RunScript(self, LatLonString: str):
        if self._stop():
            return empty_outputs()
        Lat = Grasshopper.DataTree[object]()
        Lon = Grasshopper.DataTree[object]()
        Vec = Grasshopper.DataTree[object]()
        _Results = [Lat, Lon, Vec]
        if not LatLonString:
            msg = 'Parameter LatLonString failed to collect data!'
            self._addWarning(msg)
            return _Results
        parts = LatLonString.split(',')
        if len(parts) > 2:
            msg = f'Splitting of Lat/Lon string failed! Raw result is {parts}...'
            self._addError(msg)
            return _Results
        Lat = float(parts[0].strip())
        Lon = float(parts[1].strip())
        Vec = Rhino.Geometry.Vector3d(Lat, Lon, 0)
        _Results = [Lat, Lon, Vec]
        return _Results
# ---------- end convertgeolocation ----------
location = Data(convertgeolocation.Vec)

actorkind = ValueList({"CSC user account (user)": "user", "Person (person)": "person", "Organization (organization)": "organization"}, selected="Person (person)")
actorrole = ValueList({"Operator (operator)": "operator", "Supervisor (supervisor)": "supervisor", "Laboratory (laboratory)": "laboratory", "Client (client)": "client", "Witness (witness)": "witness"}, selected="Operator (operator)")
actor = Actor(Kind=actorkind, Name="Franklin Re-Usevelt", Role=actorrole)  # -> Actor; inputs Kind: String, UserID: String, Name: String, Organization: String, OrganizationROR: String, ORCID: String, Email: String, Role: String, Me: Boolean
# ---------- actor: Python ----------
#! python3
# -*- coding: utf-8 -*-
# venv: DDU_CSC
# r: charset_normalizer
# r: numpy==2.0.2
print('ENV OK!')

# PYTHON STANDARD LIBRARY IMPORTS ---------------------------------------------
import json  # NOQA
import time  # NOQA

# RHINO AND GH RELATED IMPORTS ------------------------------------------------
import System  # NOQA
import Rhino  # NOQA
import Grasshopper  # NOQA
import scriptcontext as sc  # NOQA

# GHENV COMPONENT SETTINGS ----------------------------------------------------
ghenv.Component.Name = 'Actor'  # NOQA
ghenv.Component.NickName = 'Actor'  # NOQA
ghenv.Component.Category = 'DDU_CSC'  # NOQA
ghenv.Component.SubCategory = '3 Component Operations'  # NOQA
ghenv.Component.Description = (  # NOQA
    'Builds one actor (a person or an organization, optionally a '
    'catalog account) as JSON for Origin or an evidence record. Kind is '
    'guessed when empty: a user id makes a user, only an organization '
    'an organization, else a person. With Me set to true the actor is the '
    'signed-in account (sign in with the Session component first): its '
    'id, name, organization, ROR and ORCID come from the profile in the '
    'web settings, the role from Role or else the profile\'s default role; '
    'any input you fill in overrides the profile value.'
)

# CSC LIBRARY (decision 8.111) ----------------------------------------------
CSC_GH_MINIMUM = '261012'
LIBRARY_PROBLEM = None
try:
    import csc_gh
    csc_gh.require(CSC_GH_MINIMUM)
    from csc_gh.build import (BuildError, actor, actor_from_profile, cached_profile)  # NOQA
    from csc_gh.upload import (http_error_text)  # NOQA
except ImportError:
    LIBRARY_PROBLEM = (
        'CSC library 261012 too old or missing: run CSC_Update, '
        'then restart Rhino')

NOT_SIGNED_IN = ('Me needs a signed-in session: sign in with the Session '
                 'component first')

# OPTIONAL HELPERS: they never block the component (decisions 8.112, 8.113) ---
try:
    from csc_gh.ports import ensure_outputs
    from csc_gh.messages import set_state
except ImportError:
    ensure_outputs = set_state = None

OUTPUTS = [
    ('Actor', 'Actor',
     'Actor JSON (a fragment of the API payload)'),
]


def empty_outputs():
    """What RunScript returns when it stops early."""
    if len(OUTPUTS) <= 1:
        return None
    return tuple(None for _ in OUTPUTS)


class CSC_Actor(Grasshopper.Kernel.GH_ScriptInstance):
    """
    Author: Max Benjamin Eschenbach
    License: MIT License
    Version: 261012
    """

    _outputs_ready = True       # set by BeforeRunScript (8.112)
    _outputs_note = None

    def __init__(self):
        """Initialize this component and set component parameters."""
        super().__init__()
        self.Component = ghenv.Component  # NOQA
        self.InputParams = self.Component.Params.Input
        self.OutputParams = self.Component.Params.Output

    def _addRemark(self, msg: str = ''):
        rml = self.Component.RuntimeMessageLevel.Remark
        self.AddRuntimeMessage(rml, msg)

    def _addWarning(self, msg: str = ''):
        rml = self.Component.RuntimeMessageLevel.Warning
        self.AddRuntimeMessage(rml, msg)

    def _addError(self, msg: str = ''):
        rml = self.Component.RuntimeMessageLevel.Error
        self.AddRuntimeMessage(rml, msg)

    def _state(self, text=''):
        """The one short state under the component (decision 8.113)."""
        if set_state is not None:
            set_state(self.Component, text)

    def _stop(self):
        """True when RunScript has to return early: the library is missing or
        too old, or the outputs were just updated (says why)."""
        if LIBRARY_PROBLEM:
            self._addError(LIBRARY_PROBLEM)
            return True
        if self._outputs_note:
            self._addRemark(self._outputs_note)
        return not self._outputs_ready

    def _check_outputs(self):
        """Make the outputs match OUTPUTS before the script runs (8.112)."""
        self._outputs_ready, self._outputs_note = True, None
        if ensure_outputs is None:
            self._outputs_note = (
                'output check skipped: CSC library not installed')
            return
        status = ensure_outputs(self.Component, OUTPUTS)
        self._outputs_ready, self._outputs_note = status.ready, status.remark

    def BeforeRunScript(self):
        """Perform some setup actions."""
        self.InputParams[0].Description = (
            'user, person or organization (empty: guessed)'
        )
        self.InputParams[1].Description = (
            'Id of a catalog account (kind user)'
        )
        self.InputParams[2].Description = (
            'Name of a person (shown to signed-in users only)'
        )
        self.InputParams[3].Description = (
            'Organization, e.g. a laboratory or contractor'
        )
        self.InputParams[4].Description = (
            'ROR identifier of the organization'
        )
        self.InputParams[5].Description = (
            'ORCID of a person'
        )
        self.InputParams[6].Description = (
            'E-mail address (shown to moderators only)'
        )
        self.InputParams[7].Description = (
            'operator, supervisor, laboratory, client or witness (with Me: '
            'empty takes the default role of your profile)'
        )
        self.InputParams[8].Description = (
            'True: the actor is the signed-in account, filled from its '
            'profile (name, organization, ROR, ORCID); what you fill in '
            'overrides it. Needs the Session component signed in'
        )
        # Initialize output param descriptions
        self._check_outputs()
        if LIBRARY_PROBLEM is None:
            csc_gh.dev_reload(globals())

    def read_profile(self):
        """The profile of the signed-in account (``GET /users/me``), read at
        most once a minute per server and user."""
        auth_core = sc.sticky.get('CSC_AuthCore')
        if auth_core is None or not auth_core.is_valid():
            raise BuildError(NOT_SIGNED_IN)

        def fetch():
            response = auth_core.authorized_get('/users/me')
            if response.status_code == 401:
                raise BuildError(NOT_SIGNED_IN)
            if response.status_code != 200:
                raise BuildError(http_error_text(
                    response, 'Reading the profile'))
            return response.json()

        key = (auth_core.base_url, auth_core.get_username())
        return cached_profile(sc.sticky, key, fetch, time.time())

    def RunScript(self,
            Kind: str,
            UserID: str,
            Name: str,
            Organization: str,
            OrganizationROR: str,
            ORCID: str,
            Email: str,
            Role: str,
            Me: bool):
        if self._stop():
            return empty_outputs()
        Actor = ''
        try:
            if Me:
                profile = self.read_profile()
                fragment = actor_from_profile(
                    profile, Kind, UserID, Name, Organization,
                    OrganizationROR, ORCID, Email, Role)
                own_id = str(profile.get('_id') or profile.get('id') or '')
                if fragment.get('user_id') != own_id:
                    self._addWarning(
                        'UserID differs from the signed-in account: the '
                        'actor names another account, with your profile '
                        'values for everything you did not fill in')
            else:
                fragment = actor(Kind, UserID, Name, Organization,
                                 OrganizationROR, ORCID, Email, Role)
            Actor = json.dumps(fragment)
            return Actor
        except BuildError as error:
            self._addError(str(error))
        except Exception as error:
            msg = f'Unexpected error: {error}'
            self._addError(msg)
        return Actor
# ---------- end actor ----------
actor_2 = Data(actor)

# Step 2
originkind = ValueList({"Deinstalled (deinstallation)": "deinstallation", "Recovered from demolition (demolition)": "demolition", "Production offcut (offcut)": "offcut", "Surplus (surplus)": "surplus", "Unknown (unknown)": "unknown"}, selected="Production offcut (offcut)")
location_2 = Data(location)
actor_3 = Data(actor_2)
origin = Origin(
    Kind=originkind,
    At="2026",
    PlaceName="Digital Design Unit",
    PlaceAddress="El Lissitzky Str. 1, Darmstadt",
    PlaceLocation=location_2,
    PerformedBy=actor_3)  # -> Origin; inputs Kind: String, At: String, AtPrecision: String, PlaceName: String, PlaceAddress: String, PlaceLocation: Vector3d, WorkName: String, WorkYear: String, WorkUse: String, WorkMethod: String, Method: String, PerformedBy: list, Notes: String, PositionInWork: String, Planned: Boolean
# ---------- origin: Python ----------
#! python3
# -*- coding: utf-8 -*-
# venv: DDU_CSC
# r: charset_normalizer
# r: numpy==2.0.2
print('ENV OK!')

# PYTHON STANDARD LIBRARY IMPORTS ---------------------------------------------
import json  # NOQA

# RHINO AND GH RELATED IMPORTS ------------------------------------------------
import System  # NOQA
import Rhino  # NOQA
import Grasshopper  # NOQA

# GHENV COMPONENT SETTINGS ----------------------------------------------------
ghenv.Component.Name = 'Origin'  # NOQA
ghenv.Component.NickName = 'Origin'  # NOQA
ghenv.Component.Category = 'DDU_CSC'  # NOQA
ghenv.Component.SubCategory = '3 Component Operations'  # NOQA
ghenv.Component.Description = (  # NOQA
    'Builds the origin of a component, how it entered circulation '
    '(deinstallation, demolition, offcut, surplus or unknown), as JSON '
    'for IdentityMetadata. Dates: 2024, 2024-05, 2024-05-03 or '
    '2024-05-03T14:30:00Z; the precision follows the text. Planned marks '
    'a piece that is still in place (not yet deinstalled), At is then the '
    'planned date or empty.'
)

# CSC LIBRARY (decision 8.111) ----------------------------------------------
CSC_GH_MINIMUM = '261005a'
LIBRARY_PROBLEM = None
try:
    import csc_gh
    csc_gh.require(CSC_GH_MINIMUM)
    from csc_gh.build import (BuildError, origin)  # NOQA
except ImportError:
    LIBRARY_PROBLEM = (
        'CSC library 261005a too old or missing: run CSC_Update, '
        'then restart Rhino')

# OPTIONAL HELPERS: they never block the component (decisions 8.112, 8.113) ---
try:
    from csc_gh.ports import ensure_outputs
    from csc_gh.messages import set_state
except ImportError:
    ensure_outputs = set_state = None

OUTPUTS = [
    ('Origin', 'Origin',
     'Origin JSON (a fragment of the API payload)'),
]


def empty_outputs():
    """What RunScript returns when it stops early."""
    if len(OUTPUTS) == 1:
        return None
    return tuple(None for _ in OUTPUTS)


class CSC_Origin(Grasshopper.Kernel.GH_ScriptInstance):
    """
    Author: Max Benjamin Eschenbach
    License: MIT License
    Version: 261005a
    """

    _outputs_ready = True       # set by BeforeRunScript (8.112)
    _outputs_note = None

    def __init__(self):
        """Initialize this component and set component parameters."""
        super().__init__()
        self.Component = ghenv.Component  # NOQA
        self.InputParams = self.Component.Params.Input
        self.OutputParams = self.Component.Params.Output

    def _addRemark(self, msg: str = ''):
        rml = self.Component.RuntimeMessageLevel.Remark
        self.AddRuntimeMessage(rml, msg)

    def _addWarning(self, msg: str = ''):
        rml = self.Component.RuntimeMessageLevel.Warning
        self.AddRuntimeMessage(rml, msg)

    def _addError(self, msg: str = ''):
        rml = self.Component.RuntimeMessageLevel.Error
        self.AddRuntimeMessage(rml, msg)

    def _state(self, text=''):
        """The one short state under the component (decision 8.113)."""
        if set_state is not None:
            set_state(self.Component, text)

    def _stop(self):
        """True when RunScript has to return early: the library is missing or
        too old, or the outputs were just updated (says why)."""
        if LIBRARY_PROBLEM:
            self._addError(LIBRARY_PROBLEM)
            return True
        if self._outputs_note:
            self._addRemark(self._outputs_note)
        return not self._outputs_ready

    def _check_outputs(self):
        """Make the outputs match OUTPUTS before the script runs (8.112)."""
        self._outputs_ready, self._outputs_note = True, None
        if ensure_outputs is None:
            self._outputs_note = (
                'output check skipped: CSC library not installed')
            return
        status = ensure_outputs(self.Component, OUTPUTS)
        self._outputs_ready, self._outputs_note = status.ready, status.remark

    def BeforeRunScript(self):
        """Perform some setup actions."""
        self.InputParams[0].Description = (
            'deinstallation, demolition, offcut, surplus or unknown'
        )
        self.InputParams[1].Description = (
            'When the piece entered circulation (2024, 2024-05, ...)'
        )
        self.InputParams[2].Description = (
            'exact, day, month, year or unknown (empty: from At)'
        )
        self.InputParams[3].Description = (
            'Name of the place, e.g. a building or site'
        )
        self.InputParams[4].Description = (
            'Address of the place'
        )
        self.InputParams[5].Description = (
            'Latitude (X) and longitude (Y) of the place'
        )
        self.InputParams[6].Description = (
            'Name of the construction work the piece came from (deinstallation '
            '/ demolition only)'
        )
        self.InputParams[7].Description = (
            'Year the work was built'
        )
        self.InputParams[8].Description = (
            'Use of the work'
        )
        self.InputParams[9].Description = (
            'monolithic, prefabricated, mixed or unknown'
        )
        self.InputParams[10].Description = (
            'How the piece was recovered'
        )
        self.InputParams[11].Description = (
            'Actor JSON of who did it (from Actor)'
        )
        self.InputParams[12].Description = (
            'Free text'
        )
        self.InputParams[13].Description = (
            'Where in the construction work the piece sat, e.g. a floor '
            'or an axis (deinstallation / demolition only)'
        )
        if len(self.InputParams) > 14:      # an instance from before Planned
            self.InputParams[14].Description = (
                'True while the piece is still in place: identified in its '
                'works, not yet deinstalled (deinstallation / demolition '
                'only). At is then the planned date, or empty'
            )
        self._check_outputs()
        if LIBRARY_PROBLEM is None:
            csc_gh.dev_reload(globals())

    def RunScript(self,
            Kind: str,
            At: str,
            AtPrecision: str,
            PlaceName: str,
            PlaceAddress: str,
            PlaceLocation: Rhino.Geometry.Vector3d,
            WorkName: str,
            WorkYear: str,
            WorkUse: str,
            WorkMethod: str,
            Method: str,
            PerformedBy: list[object],
            Notes: str,
            PositionInWork: str,
            Planned: bool):
        if self._stop():
            return empty_outputs()
        Origin = ''
        if not PositionInWork or PositionInWork == '':
            PositionInWork = None
        try:
            lat = lon = None
            if PlaceLocation is not None:
                lat, lon = PlaceLocation.X, PlaceLocation.Y
            fragment = origin(Kind, At, AtPrecision, PlaceName, PlaceAddress, lat,
                              lon, WorkName, WorkYear, WorkUse, WorkMethod, Method,
                              list(PerformedBy or []), Notes,
                              PositionInWork, bool(Planned))
            Origin = json.dumps(fragment)
            return Origin
        except BuildError as error:
            self._addError(str(error))
        except Exception as error:
            self._addError(f'Unexpected error: {error}')
        return Origin
# ---------- end origin ----------
origin_2 = Data(origin)

originalfunction = ValueList({"Beam (IfcBeam)": "IfcBeam", "Column (IfcColumn)": "IfcColumn", "Slab (IfcSlab)": "IfcSlab", "Plate / Panel (IfcPlate)": "IfcPlate", "Wall (IfcWall)": "IfcWall", "Member (IfcMember)": "IfcMember", "Pipe (IfcPipeSegment)": "IfcPipeSegment", "Duct (IfcDuctSegment)": "IfcDuctSegment", "Footing (IfcFooting)": "IfcFooting", "Window (IfcWindow)": "IfcWindow", "Door / gate (IfcDoor)": "IfcDoor", "Stair (IfcStair)": "IfcStair", "Railing / balustrade (IfcRailing)": "IfcRailing", "Accessory / Connector (IfcDiscreteAccessory)": "IfcDiscreteAccessory", "Element part (IfcBuildingElementPart)": "IfcBuildingElementPart", "Unknown (IfcBuildingElementProxy)": "IfcBuildingElementProxy", "Debris (CscDebris)": "CscDebris"}, selected="Debris (CscDebris)")
material = ValueList({"Concrete (concrete)": "concrete", "Autoclaved aerated concrete (autoclaved_aerated_concrete)": "autoclaved_aerated_concrete", "Fired clay (fired_clay)": "fired_clay", "Calcium silicate (calcium_silicate)": "calcium_silicate", "Ceramic (ceramic)": "ceramic", "Natural stone (natural_stone)": "natural_stone", "Mixed mineral (mineral_mixture)": "mineral_mixture", "Gypsum (gypsum)": "gypsum", "Glass (glass)": "glass", "Steel (steel)": "steel"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}, selected="Concrete (concrete)")
origin_3 = Data(origin_2)
identitymetadata = IdentityMetadata(OriginalFunction=originalfunction, Material=material, TradeName="Corian", Origin=origin_3)  # -> IdentityMetadata; inputs OriginalFunction: String, Material: String, TradeName: String, Manufacturer: String, ManufacturedAt: String, Origin: String, IsPublic: Boolean, Attributes: String, MaterialClass: String, ManufacturedPrecision: String
# ---------- identitymetadata: Python ----------
#! python3
# -*- coding: utf-8 -*-
# venv: DDU_CSC
# r: charset_normalizer
# r: numpy==2.0.2
print('ENV OK!')

# PYTHON STANDARD LIBRARY IMPORTS ---------------------------------------------
import json  # NOQA

# RHINO AND GH RELATED IMPORTS ------------------------------------------------
import System  # NOQA
import Rhino  # NOQA
import Grasshopper  # NOQA

# GHENV COMPONENT SETTINGS ----------------------------------------------------
ghenv.Component.Name = 'IdentityMetadata'  # NOQA
ghenv.Component.NickName = 'IdentityMetadata'  # NOQA
ghenv.Component.Category = 'DDU_CSC'  # NOQA
ghenv.Component.SubCategory = '3 Component Operations'  # NOQA
ghenv.Component.Description = (  # NOQA
    'Builds the fields of a new component that belong to the piece '
    'itself (original function, material, trade name, manufacturer, '
    'manufacture date, origin) as JSON for CreateComponentIdentity. A '
    'cut piece leaves it out: everything it does not state comes from '
    'its parents.'
)

# CSC LIBRARY (decision 8.111) ----------------------------------------------
CSC_GH_MINIMUM = '261005'
LIBRARY_PROBLEM = None
try:
    import csc_gh
    csc_gh.require(CSC_GH_MINIMUM)
    from csc_gh.build import (BuildError, identity_metadata)  # NOQA
except ImportError:
    LIBRARY_PROBLEM = (
        'CSC library 261005 too old or missing: run CSC_Update, '
        'then restart Rhino')

# OPTIONAL HELPERS: they never block the component (decisions 8.112, 8.113) ---
try:
    from csc_gh.ports import ensure_outputs
    from csc_gh.messages import set_state
except ImportError:
    ensure_outputs = set_state = None

OUTPUTS = [
    ('IdentityMetadata', 'IdentityMetadata',
     'IdentityMetadata JSON (a fragment of the API payload)'),
]


def empty_outputs():
    """What RunScript returns when it stops early."""
    if len(OUTPUTS) <= 1:
        return None
    return tuple(None for _ in OUTPUTS)


class CSC_IdentityMetadata(Grasshopper.Kernel.GH_ScriptInstance):
    """
    Author: Max Benjamin Eschenbach
    License: MIT License
    Version: 261005
    """

    _outputs_ready = True       # set by BeforeRunScript (8.112)
    _outputs_note = None

    def __init__(self):
        """Initialize this component and set component parameters."""
        super().__init__()
        self.Component = ghenv.Component  # NOQA
        self.InputParams = self.Component.Params.Input
        self.OutputParams = self.Component.Params.Output

    def _addRemark(self, msg: str = ''):
        rml = self.Component.RuntimeMessageLevel.Remark
        self.AddRuntimeMessage(rml, msg)

    def _addWarning(self, msg: str = ''):
        rml = self.Component.RuntimeMessageLevel.Warning
        self.AddRuntimeMessage(rml, msg)

    def _addError(self, msg: str = ''):
        rml = self.Component.RuntimeMessageLevel.Error
        self.AddRuntimeMessage(rml, msg)

    def _state(self, text=''):
        """The one short state under the component (decision 8.113)."""
        if set_state is not None:
            set_state(self.Component, text)

    def _stop(self):
        """True when RunScript has to return early: the library is missing or
        too old, or the outputs were just updated (says why)."""
        if LIBRARY_PROBLEM:
            self._addError(LIBRARY_PROBLEM)
            return True
        if self._outputs_note:
            self._addRemark(self._outputs_note)
        return not self._outputs_ready

    def _check_outputs(self):
        """Make the outputs match OUTPUTS before the script runs (8.112)."""
        self._outputs_ready, self._outputs_note = True, None
        if ensure_outputs is None:
            self._outputs_note = (
                'output check skipped: CSC library not installed')
            return
        status = ensure_outputs(self.Component, OUTPUTS)
        self._outputs_ready, self._outputs_note = status.ready, status.remark

    def BeforeRunScript(self):
        """Perform some setup actions."""
        self.InputParams[0].Description = (
            'IFC class, e.g. IfcBeam, IfcColumn, IfcSlab, IfcPlate, CscDebris'
        )
        self.InputParams[1].Description = (
            'Material id from the controlled list, e.g. concrete'
        )
        self.InputParams[2].Description = (
            'Trade name, e.g. Corian'
        )
        self.InputParams[3].Description = (
            'Manufacturer'
        )
        self.InputParams[4].Description = (
            'Date of manufacture (2024, 2024-05, 2024-05-03)'
        )
        self.InputParams[5].Description = (
            'Origin JSON (from Origin)'
        )
        self.InputParams[6].Description = (
            'Public to anonymous readers (default false)'
        )
        self.InputParams[7].Description = (
            'Free attributes as a JSON object'
        )
        self.InputParams[8].Description = (
            'List of Waste code, e.g. 17 01 01 (empty: derived from the '
            'material)'
        )
        self.InputParams[9].Description = (
            'exact, day, month, year or unknown (empty: from '
            'ManufacturedAt)'
        )
        # Initialize output param descriptions
        self._check_outputs()
        if LIBRARY_PROBLEM is None:
            csc_gh.dev_reload(globals())

    def RunScript(self,
            OriginalFunction: str,
            Material: str,
            TradeName: str,
            Manufacturer: str,
            ManufacturedAt: str,
            Origin: str,
            IsPublic: bool,
            Attributes: str,
            MaterialClass: str,
            ManufacturedPrecision: str):
        if self._stop():
            return empty_outputs()
        IdentityMetadata = ''
        if not ManufacturedPrecision or ManufacturedPrecision == '':
            ManufacturedPrecision = None
        try:
            fragment = identity_metadata(
                OriginalFunction, Material, TradeName, Manufacturer, ManufacturedAt,
                ManufacturedPrecision, Origin, IsPublic, Attributes,
                MaterialClass)
            IdentityMetadata = json.dumps(fragment)
            return IdentityMetadata
        except BuildError as error:
            self._addError(str(error))
        except Exception as error:
            msg = f'Unexpected error: {error}'
            self._addError(msg)
        return IdentityMetadata
# ---------- end identitymetadata ----------
identitymetadata_2 = Data(identitymetadata)

# Step 1
# comments & notes: Here we fetch a Transmitted ID from a QR Code Scan.
# 
# Use https://ddu.uber.space/transmit-id on your smartphone to scan a QR code and transmit the ID!
button = Button()
# __DEVELOPMENT_CREDITS__: Authors: Max Benjamin Eschenbach
# Constributors: Alessandro Garruto
# 
# Digital Design Unit (DDU)
# Prof. Dr.-Ing. Oliver Tessmann
# Fachbereich Architektur
# Technical University of Darmstadt
# 
# CREDITS:
# ------------
# Please see: https://2ndchances.build/credits
fetchtransmittedid = FetchTransmittedID(Refresh=button)  # -> IdentityID
# ---------- fetchtransmittedid: Python ----------
#! python3
# -*- coding: utf-8 -*-
# venv: DDU_CSC
print('ENV OK!')
# r: charset_normalizer
# r: requests

# PYTHON STANDARD LIBRARY IMPORTS ---------------------------------------------
import json  # NOQA

# THIRD PARTY LIBRARY IMPORTS -------------------------------------------------
import requests  # NOQA

# RHINO AND GH RELATED IMPORTS ------------------------------------------------
import System  # NOQA
import Grasshopper  # NOQA
import Rhino  # NOQA
import scriptcontext as sc  # NOQA

# GHENV COMPONENT SETTINGS ----------------------------------------------------
ghenv.Component.Name = 'FetchTransmittedID'  # NOQA
ghenv.Component.NickName = 'FetchTransmittedID'  # NOQA
ghenv.Component.Category = 'DDU_CSC'  # NOQA
ghenv.Component.SubCategory = '2 Catalog Interface'  # NOQA
ghenv.Component.Description = (  # NOQA
    'Fetches the currently pending transmitted component ID for the signed-in '
    'user from the Catalog backend. Uses the existing CSC_Session '
    'authentication state.'
)

# OPTIONAL HELPERS: they never block the component (decisions 8.112, 8.113) ---
try:
    from csc_gh.ports import ensure_outputs
    from csc_gh.messages import set_state
except ImportError:
    ensure_outputs = set_state = None

OUTPUTS = [
    ('IdentityID', 'IdentityID',
     'The currently pending transmitted IdentityID. Empty if none is pending.'),
]


def empty_outputs():
    """What RunScript returns when it stops early."""
    if len(OUTPUTS) == 1:
        return None
    return tuple(None for _ in OUTPUTS)


class CSC_FetchTransmittedID(Grasshopper.Kernel.GH_ScriptInstance):
    """
    Author: Max Benjamin Eschenbach
    License: MIT License
    Version: 261005a
    """

    _outputs_ready = True       # set by BeforeRunScript (8.112)
    _outputs_note = None

    def __init__(self):
        """Initialize this component and set component parameters."""
        super().__init__()
        # initialize props
        self.Component = ghenv.Component  # NOQA
        self.InputParams = self.Component.Params.Input
        self.OutputParams = self.Component.Params.Output

    def _addRemark(self, msg: str = ''):
        """Add a remark message to the component."""
        rml = self.Component.RuntimeMessageLevel.Remark
        self.AddRuntimeMessage(rml, msg)

    def _addWarning(self, msg: str = ''):
        """Add a warning message to the component."""
        rml = self.Component.RuntimeMessageLevel.Warning
        self.AddRuntimeMessage(rml, msg)

    def _addError(self, msg: str = ''):
        """Add an error message to the component."""
        rml = self.Component.RuntimeMessageLevel.Error
        self.AddRuntimeMessage(rml, msg)

    def _state(self, text=''):
        """The one short state under the component (decision 8.113)."""
        if set_state is not None:
            set_state(self.Component, text)

    def _stop(self):
        """True when RunScript has to return early: the outputs were just updated (says why)."""
        if self._outputs_note:
            self._addRemark(self._outputs_note)
        return not self._outputs_ready

    def _check_outputs(self):
        """Make the outputs match OUTPUTS before the script runs (8.112)."""
        self._outputs_ready, self._outputs_note = True, None
        if ensure_outputs is None:
            self._outputs_note = (
                'output check skipped: CSC library not installed')
            return
        status = ensure_outputs(self.Component, OUTPUTS)
        self._outputs_ready, self._outputs_note = status.ready, status.remark

    def BeforeRunScript(self):
        """Perform some setup actions."""
        # Initialize output param descriptions
        i = 0
        if self.OutputParams[0].Name == 'out':
            i += 1
        self.OutputParams[0+i].Description = (
            'The currently pending transmitted IdentityID. Empty if none is '
            'pending.'
        )
        self._check_outputs()

    def get_auth_core_from_sticky(self):
        """Get AuthCore instance from sticky storage."""
        auth_core = sc.sticky.get('CSC_AuthCore')
        if auth_core is None:
            msg = ('No authentication found. Please use CSC_Session component '
                   'first.')
            self._addError(msg)
            self._state(msg)
            return None
        return auth_core

    def RunScript(self, Refresh):
        if self._stop():
            return empty_outputs()
        component_id = Grasshopper.DataTree[object]()

        # Get AuthCore instance from sticky storage
        auth_core = self.get_auth_core_from_sticky()
        if auth_core is None:
            return component_id

        # Check if authentication is valid
        if not auth_core.is_valid():
            msg = ('Authentication expired. Please use CSC_Session '
                   'component to refresh.')
            self._addError(msg)
            self._state(msg)
            return component_id

        try:
            self._state('Fetching transmitted ID...')

            response = auth_core.authorized_get('/component_id_transmission')

            if response.status_code == 200:
                payload = response.json()
                pending = payload.get('pending')

                if pending and isinstance(pending, dict):
                    component_id = str(pending.get('identity_id', '') or '')
                    self._state('Pending transmitted ID found')
                    self._addRemark(
                        f'Fetched pending transmitted ID: {component_id}'
                    )
                else:
                    self._state('No transmitted ID pending')
                    self._addRemark(
                        'No pending transmitted component ID for this user.'
                    )

                return component_id

            elif response.status_code == 401:
                msg = 'Authentication failed. Please sign in again.'
                self._addError(msg)
                self._state(msg)

            elif response.status_code == 403:
                msg = 'Access denied. Insufficient permissions.'
                self._addError(msg)
                self._state(msg)

            elif response.status_code == 500:
                msg = 'Server error. Please try again later.'
                self._addWarning(msg)
                self._state(msg)

            else:
                msg = (f'Request failed with status code: '
                       f'{response.status_code}')
                self._addError(msg)
                self._state(msg)

        except requests.exceptions.ConnectionError as e:
            msg = 'Cannot connect to server. Please check your connection.'
            self._addError(msg + f'\nFull Error: {str(e)}')
            self._state(msg)

        except requests.exceptions.Timeout as e:
            msg = 'Request timeout. Server may be slow.'
            self._addError(msg + f'\nFull Error: {str(e)}')
            self._state(msg)

        except requests.exceptions.RequestException as e:
            msg = f'Request error: {str(e)}'
            self._addError(msg)
            self._state(msg)

        except Exception as e:
            msg = f'Unexpected error: {str(e)}'
            self._addError(msg)
            self._state(msg)

        return component_id
# ---------- end fetchtransmittedid ----------
componentid = Panel(fetchtransmittedid)

# comments & notes: Create UUIDs on request
button_2 = Button()
createuuid = CreateUUID(Refresh=button_2)  # -> UUID; inputs Refresh: Boolean
# ---------- createuuid: Python ----------
#! python3
# -*- coding: utf-8 -*-
# venv: DDU_CSC
print('ENV OK!')
# r: charset_normalizer
# r: requests

# PYTHON STANDARD LIBRARY IMPORTS ---------------------------------------------
import uuid  # NOQA

# RHINO AND GH RELATED IMPORTS ------------------------------------------------
import System  # NOQA
import Rhino  # NOQA
import Grasshopper  # NOQA
from scriptcontext import sticky as st  # NOQA

# GHENV COMPONENT SETTINGS ----------------------------------------------------
ghenv.Component.Name = 'CreateUUID'  # NOQA
ghenv.Component.NickName = 'CreateUUID'  # NOQA
ghenv.Component.Category = 'DDU_CSC'  # NOQA
ghenv.Component.SubCategory = '3 Component Operations'  # NOQA
ghenv.Component.Description = (  # NOQA
    'Creates new UUIDs on request.'
)

# OPTIONAL HELPERS: they never block the component (decisions 8.112, 8.113) ---
try:
    from csc_gh.ports import ensure_outputs
    from csc_gh.messages import set_state
except ImportError:
    ensure_outputs = set_state = None

OUTPUTS = [
    ('UUID', 'UUID',
     'The current UUID'),
]


def empty_outputs():
    """What RunScript returns when it stops early."""
    if len(OUTPUTS) == 1:
        return None
    return tuple(None for _ in OUTPUTS)


class CSC_CreateUUID(Grasshopper.Kernel.GH_ScriptInstance):
    """
    Author: Max Benjamin Eschenbach
    License: MIT License
    Version: 261005a
    """

    _outputs_ready = True       # set by BeforeRunScript (8.112)
    _outputs_note = None

    def __init__(self):
        """Initialize this component and set component parameters."""
        super().__init__()
        # initialize props
        self.Component = ghenv.Component  # NOQA
        self.InputParams = self.Component.Params.Input
        self.OutputParams = self.Component.Params.Output

    def _addRemark(self, msg: str = ''):
        """Add a remark message to the component."""
        rml = self.Component.RuntimeMessageLevel.Remark
        self.AddRuntimeMessage(rml, msg)

    def _addWarning(self, msg: str = ''):
        """Add a warning message to the component."""
        rml = self.Component.RuntimeMessageLevel.Warning
        self.AddRuntimeMessage(rml, msg)

    def _addError(self, msg: str = ''):
        """Add an error message to the component."""
        rml = self.Component.RuntimeMessageLevel.Error
        self.AddRuntimeMessage(rml, msg)

    def _state(self, text=''):
        """The one short state under the component (decision 8.113)."""
        if set_state is not None:
            set_state(self.Component, text)

    def _stop(self):
        """True when RunScript has to return early: the outputs were just updated (says why)."""
        if self._outputs_note:
            self._addRemark(self._outputs_note)
        return not self._outputs_ready

    def _check_outputs(self):
        """Make the outputs match OUTPUTS before the script runs (8.112)."""
        self._outputs_ready, self._outputs_note = True, None
        if ensure_outputs is None:
            self._outputs_note = (
                'output check skipped: CSC library not installed')
            return
        status = ensure_outputs(self.Component, OUTPUTS)
        self._outputs_ready, self._outputs_note = status.ready, status.remark

    def BeforeRunScript(self):
        """Perform some setup actions."""
        # Initialize input param descriptions
        self.InputParams[0].Description = (
            'If set to True, generates a new UUID'
        )
        self._check_outputs()

    def _updateComponent(self):
        """Updates this component using callback mechanism"""
        # Define callback action
        def callBack(e):
            st_key = f'{self.Component.InstanceGuid}__CreateUUIDComponent'
            new_uuid = uuid.uuid4()
            st[st_key] = new_uuid
            self.Component.ExpireSolution(False)  # NOQA
            return
        # Get grasshopper document
        ghDoc = ghenv.Component.OnPingDocument()  # NOQA
        # Schedule this component to expire
        ghDoc.ScheduleSolution(
            1,
            Grasshopper.Kernel.GH_Document.GH_ScheduleDelegate(callBack)
        )
        return False

    def RunScript(self, Refresh: bool):
        if self._stop():
            return empty_outputs()
        st_key = f'{self.Component.InstanceGuid}__CreateUUIDComponent'
        if Refresh or st_key not in st.keys():
            create_new_uuid = True
        else:
            create_new_uuid = False
        if create_new_uuid:
            create_new_uuid = self._updateComponent()
        return st[st_key]
# ---------- end createuuid ----------
componentid_2 = Panel(createuuid)

# Example 07:
# - Creating a new, (derived) component identity in the catalog
location_3 = Data(location)

component_name = Panel("Reinforcement Demo 01")
fragment = BooleanToggle(True)
color = ColourSwatch(SwatchColor=RGB(189, 189, 189))
snapshotmetadata = SnapshotMetadata(Name=component_name, Fragment=fragment, Color=color, Location=location_3)  # -> SnapshotMetadata; inputs Name: String, Fragment: Boolean, Quantity: Int32, Color: Color, Location: Vector3d, Notes: String, EffectiveFrom: String, ShapeClass: String, Complexity: Int32, EffectiveFromPrecision: String
# ---------- snapshotmetadata: Python ----------
#! python3
# -*- coding: utf-8 -*-
# venv: DDU_CSC
# r: charset_normalizer
# r: numpy==2.0.2
print('ENV OK!')

# PYTHON STANDARD LIBRARY IMPORTS ---------------------------------------------
import json  # NOQA

# RHINO AND GH RELATED IMPORTS ------------------------------------------------
import System  # NOQA
import Rhino  # NOQA
import Grasshopper  # NOQA

# GHENV COMPONENT SETTINGS ----------------------------------------------------
ghenv.Component.Name = 'SnapshotMetadata'  # NOQA
ghenv.Component.NickName = 'SnapshotMetadata'  # NOQA
ghenv.Component.Category = 'DDU_CSC'  # NOQA
ghenv.Component.SubCategory = '3 Component Operations'  # NOQA
ghenv.Component.Description = (  # NOQA
    'Builds the fields of one recorded state (name, fragment, quantity, '
    'colour, location, notes, start date) as JSON for '
    'CreateComponentSnapshot / CreateComponentIdentity. Shape class and '
    'complexity are derived by the server; set them only to override.'
)

# CSC LIBRARY (decision 8.111) ----------------------------------------------
CSC_GH_MINIMUM = '261005'
LIBRARY_PROBLEM = None
try:
    import csc_gh
    csc_gh.require(CSC_GH_MINIMUM)
    from csc_gh.build import (BuildError, snapshot_metadata)  # NOQA
except ImportError:
    LIBRARY_PROBLEM = (
        'CSC library 261005 too old or missing: run CSC_Update, '
        'then restart Rhino')

# OPTIONAL HELPERS: they never block the component (decisions 8.112, 8.113) ---
try:
    from csc_gh.ports import ensure_outputs
    from csc_gh.messages import set_state
except ImportError:
    ensure_outputs = set_state = None

OUTPUTS = [
    ('SnapshotMetadata', 'SnapshotMetadata',
     'SnapshotMetadata JSON (a fragment of the API payload)'),
]


def empty_outputs():
    """What RunScript returns when it stops early."""
    if len(OUTPUTS) <= 1:
        return None
    return tuple(None for _ in OUTPUTS)


class CSC_SnapshotMetadata(Grasshopper.Kernel.GH_ScriptInstance):
    """
    Author: Max Benjamin Eschenbach
    License: MIT License
    Version: 261005
    """

    _outputs_ready = True       # set by BeforeRunScript (8.112)
    _outputs_note = None

    def __init__(self):
        """Initialize this component and set component parameters."""
        super().__init__()
        self.Component = ghenv.Component  # NOQA
        self.InputParams = self.Component.Params.Input
        self.OutputParams = self.Component.Params.Output

    def _addRemark(self, msg: str = ''):
        rml = self.Component.RuntimeMessageLevel.Remark
        self.AddRuntimeMessage(rml, msg)

    def _addWarning(self, msg: str = ''):
        rml = self.Component.RuntimeMessageLevel.Warning
        self.AddRuntimeMessage(rml, msg)

    def _addError(self, msg: str = ''):
        rml = self.Component.RuntimeMessageLevel.Error
        self.AddRuntimeMessage(rml, msg)

    def _state(self, text=''):
        """The one short state under the component (decision 8.113)."""
        if set_state is not None:
            set_state(self.Component, text)

    def _stop(self):
        """True when RunScript has to return early: the library is missing or
        too old, or the outputs were just updated (says why)."""
        if LIBRARY_PROBLEM:
            self._addError(LIBRARY_PROBLEM)
            return True
        if self._outputs_note:
            self._addRemark(self._outputs_note)
        return not self._outputs_ready

    def _check_outputs(self):
        """Make the outputs match OUTPUTS before the script runs (8.112)."""
        self._outputs_ready, self._outputs_note = True, None
        if ensure_outputs is None:
            self._outputs_note = (
                'output check skipped: CSC library not installed')
            return
        status = ensure_outputs(self.Component, OUTPUTS)
        self._outputs_ready, self._outputs_note = status.ready, status.remark

    def BeforeRunScript(self):
        """Perform some setup actions."""
        self.InputParams[0].Description = (
            'Name of the component (empty: its catalog number)'
        )
        self.InputParams[1].Description = (
            'The piece is a fragment of a bigger one'
        )
        self.InputParams[2].Description = (
            'Number of identical pieces (default 1)'
        )
        self.InputParams[3].Description = (
            'Colour of the piece'
        )
        self.InputParams[4].Description = (
            'Latitude (X) and longitude (Y)'
        )
        self.InputParams[5].Description = (
            'Free text (up to 5000 characters)'
        )
        self.InputParams[6].Description = (
            'When this state started (empty: now; 2024-05-03, ...)'
        )
        self.InputParams[7].Description = (
            'Override: linear, planar, block, irregular or composite'
        )
        self.InputParams[8].Description = (
            'Override: 0 to 3'
        )
        self.InputParams[9].Description = (
            'exact, day, month, year or unknown (empty: from '
            'EffectiveFrom)'
        )
        # Initialize output param descriptions
        self._check_outputs()
        if LIBRARY_PROBLEM is None:
            csc_gh.dev_reload(globals())

    def RunScript(self,
            Name: str,
            Fragment: bool,
            Quantity: int,
            Color: System.Drawing.Color,
            Location: Rhino.Geometry.Vector3d,
            Notes: str,
            EffectiveFrom: str,
            ShapeClass: str,
            Complexity: int,
            EffectiveFromPrecision: str):
        if self._stop():
            return empty_outputs()
        SnapshotMetadata = ''
        if not EffectiveFromPrecision or EffectiveFromPrecision == '':
            EffectiveFromPrecision = None
        try:
            rgb_value = None
            if Color is not None:
                rgb_value = [Color.R, Color.G, Color.B]
            lat = lon = None
            if Location is not None:
                lat, lon = Location.X, Location.Y
            fragment = snapshot_metadata(
                Name, Fragment, Quantity, rgb_value, lat, lon, Notes, EffectiveFrom,
                EffectiveFromPrecision, ShapeClass, Complexity)
            SnapshotMetadata = json.dumps(fragment)
            return SnapshotMetadata
        except BuildError as error:
            self._addError(str(error))
        except Exception as error:
            msg = f'Unexpected error: {error}'
            self._addError(msg)
        return SnapshotMetadata
# ---------- end snapshotmetadata ----------
snapshotmetadata_2 = Data(snapshotmetadata)

capture = Capture()  # -> Capture; inputs Method: String, Device: String, Software: String, CapturedAt: String, Notes: String, CoordinateSystem: String, CoordinateSystemNote: String, MarkerPoints: list of Point3d, MarkerLabels: list, MarkerRoles: list, Fixtures: list
# ---------- capture: Python ----------
#! python3
# -*- coding: utf-8 -*-
# venv: DDU_CSC
# r: charset_normalizer
# r: numpy==2.0.2
print('ENV OK!')

# PYTHON STANDARD LIBRARY IMPORTS ---------------------------------------------
import json  # NOQA

# RHINO AND GH RELATED IMPORTS ------------------------------------------------
import System  # NOQA
import Rhino  # NOQA
import Grasshopper  # NOQA

# GHENV COMPONENT SETTINGS ----------------------------------------------------
ghenv.Component.Name = 'Capture'  # NOQA
ghenv.Component.NickName = 'Capture'  # NOQA
ghenv.Component.Category = 'DDU_CSC'  # NOQA
ghenv.Component.SubCategory = '3 Component Operations'  # NOQA
ghenv.Component.Description = (  # NOQA
    'Builds how the geometry of a state was recorded (method, device, '
    'software, coordinate system, markers, fixtures) as JSON for '
    'CreateComponentSnapshot / CreateComponentIdentity. Markers and '
    'fixtures (a scanning rig) are never part of the geometry of the '
    'component itself.'
)

# CSC LIBRARY (decision 8.111) ----------------------------------------------
CSC_GH_MINIMUM = '261005'
LIBRARY_PROBLEM = None
try:
    import csc_gh
    csc_gh.require(CSC_GH_MINIMUM)
    from csc_gh.build import (BuildError, capture)  # NOQA
except ImportError:
    LIBRARY_PROBLEM = (
        'CSC library 261005 too old or missing: run CSC_Update, '
        'then restart Rhino')

# OPTIONAL HELPERS: they never block the component (decisions 8.112, 8.113) ---
try:
    from csc_gh.ports import ensure_outputs
    from csc_gh.messages import set_state
except ImportError:
    ensure_outputs = set_state = None

OUTPUTS = [
    ('Capture', 'Capture',
     'Capture JSON (a fragment of the API payload)'),
]


def empty_outputs():
    """What RunScript returns when it stops early."""
    if len(OUTPUTS) <= 1:
        return None
    return tuple(None for _ in OUTPUTS)


class CSC_Capture(Grasshopper.Kernel.GH_ScriptInstance):
    """
    Author: Max Benjamin Eschenbach
    License: MIT License
    Version: 261005
    """

    _outputs_ready = True       # set by BeforeRunScript (8.112)
    _outputs_note = None

    def __init__(self):
        """Initialize this component and set component parameters."""
        super().__init__()
        self.Component = ghenv.Component  # NOQA
        self.InputParams = self.Component.Params.Input
        self.OutputParams = self.Component.Params.Output

    def _addRemark(self, msg: str = ''):
        rml = self.Component.RuntimeMessageLevel.Remark
        self.AddRuntimeMessage(rml, msg)

    def _addWarning(self, msg: str = ''):
        rml = self.Component.RuntimeMessageLevel.Warning
        self.AddRuntimeMessage(rml, msg)

    def _addError(self, msg: str = ''):
        rml = self.Component.RuntimeMessageLevel.Error
        self.AddRuntimeMessage(rml, msg)

    def _state(self, text=''):
        """The one short state under the component (decision 8.113)."""
        if set_state is not None:
            set_state(self.Component, text)

    def _stop(self):
        """True when RunScript has to return early: the library is missing or
        too old, or the outputs were just updated (says why)."""
        if LIBRARY_PROBLEM:
            self._addError(LIBRARY_PROBLEM)
            return True
        if self._outputs_note:
            self._addRemark(self._outputs_note)
        return not self._outputs_ready

    def _check_outputs(self):
        """Make the outputs match OUTPUTS before the script runs (8.112)."""
        self._outputs_ready, self._outputs_note = True, None
        if ensure_outputs is None:
            self._outputs_note = (
                'output check skipped: CSC library not installed')
            return
        status = ensure_outputs(self.Component, OUTPUTS)
        self._outputs_ready, self._outputs_note = status.ready, status.remark

    def BeforeRunScript(self):
        """Perform some setup actions."""
        self.InputParams[0].Description = (
            'photogrammetry, lidar, structured_light or manual'
        )
        self.InputParams[1].Description = (
            'Scanner or camera'
        )
        self.InputParams[2].Description = (
            'Software that made the geometry'
        )
        self.InputParams[3].Description = (
            'When it was captured (2024-05-03, ...)'
        )
        self.InputParams[4].Description = (
            'Free text'
        )
        self.InputParams[5].Description = (
            'Name of the coordinate system the geometry is in, e.g. the gripper '
            'marker plane'
        )
        self.InputParams[6].Description = (
            'Description of that coordinate system'
        )
        self.InputParams[7].Description = (
            'Marker points'
        )
        self.InputParams[8].Description = (
            'One label per marker point'
        )
        self.InputParams[9].Description = (
            'rig or component, one per marker point (default component)'
        )
        self.InputParams[10].Description = (
            'Fixtures as label|file name'
        )
        # Initialize output param descriptions
        self._check_outputs()
        if LIBRARY_PROBLEM is None:
            csc_gh.dev_reload(globals())

    def RunScript(self,
            Method: str,
            Device: str,
            Software: str,
            CapturedAt: str,
            Notes: str,
            CoordinateSystem: str,
            CoordinateSystemNote: str,
            MarkerPoints: list[Rhino.Geometry.Point3d],
            MarkerLabels: list[object],
            MarkerRoles: list[object],
            Fixtures: list[object]):
        if self._stop():
            return empty_outputs()
        Capture = ''
        try:
            points = list(MarkerPoints or [])
            labels = list(MarkerLabels or [])
            roles = list(MarkerRoles or [])
            if points and len(labels) not in (len(points),):
                raise BuildError('give one MarkerLabel per marker point '
                                 f'({len(points)} points, {len(labels)} labels)')
            if roles and len(roles) not in (1, len(points)):
                raise BuildError('give one MarkerRole for all points or one per '
                                 'point')
            marker_items = []
            for index, point in enumerate(points):
                role = (roles[0] if len(roles) == 1 else roles[index]) \
                    if roles else None
                marker_items.append((labels[index], role,
                                     (point.X, point.Y, point.Z)))
            fixture_items = []
            for item in Fixtures or []:
                label, _, file_name = str(item).partition('|')
                fixture_items.append((label, file_name))
            fragment = capture(Method, Device, Software, CapturedAt, Notes,
                               CoordinateSystem, CoordinateSystemNote, marker_items,
                               fixture_items)
            Capture = json.dumps(fragment)
            return Capture
        except BuildError as error:
            self._addError(str(error))
        except Exception as error:
            msg = f'Unexpected error: {error}'
            self._addError(msg)
        return Capture
# ---------- end capture ----------
capture_2 = Data(capture)

# ParentIdentity: IMPORTANT: Here goes the UUID of the parent component (the component that your new, cut to shape piece was made from!)
parentidentity = Panel("")

# comments & notes: Here we create a new component identity (locally).
# 
# Most of the fields are already pre-set for you.
# You need to adjust:
# - Name
# - Dataset
# - Color
# - Parent Identity ID if applicable(Important!)
samplemeshgeometry = Mesh(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)
clearlocalstorage = Button()
transmittedidentityid = Data(componentid_2)
identitymetadata_3 = Data(identitymetadata_2)
snapshotmetadata_3 = Data(snapshotmetadata_2)
capture_3 = Data(capture_2)
geometry = Data(samplemeshgeometry)
createcomponentidentity = CreateComponentIdentity(
    ClearLocalStorage=clearlocalstorage,
    IdentityID=transmittedidentityid,
    Dataset="demo",
    Identity=identitymetadata_3,
    Snapshot=snapshotmetadata_3,
    Capture=capture_3,
    Geometry=geometry,
    ParentIdentity=parentidentity,
    Centre=Toggle(True))  # -> IdentityRequest; inputs ClearLocalStorage: Boolean, IdentityID: String, Dataset: String, Identity: String, Snapshot: String, Capture: String, Geometry: list of GeometryBase, ParentIdentity: list, Centre: Boolean
# ---------- createcomponentidentity: Python ----------
#! python3
# -*- coding: utf-8 -*-
# venv: DDU_CSC
# r: charset_normalizer
# r: numpy==2.0.2
print('ENV OK!')

# PYTHON STANDARD LIBRARY IMPORTS ---------------------------------------------
import json  # NOQA
import os  # NOQA
import uuid  # NOQA

# RHINO AND GH RELATED IMPORTS ------------------------------------------------
import System  # NOQA
import Rhino  # NOQA
import Grasshopper  # NOQA

# GHENV COMPONENT SETTINGS ----------------------------------------------------
ghenv.Component.Name = 'CreateComponentIdentity'  # NOQA
ghenv.Component.NickName = 'CreateComponentIdentity'  # NOQA
ghenv.Component.Category = 'DDU_CSC'  # NOQA
ghenv.Component.SubCategory = '3 Component Operations'  # NOQA
ghenv.Component.Description = (  # NOQA
    'Builds the request that records a new component with its first '
    'state (POST /identities): ids, dataset, the builder objects '
    '(IdentityMetadata, SnapshotMetadata, Capture), geometry and, for a '
    'cut piece, its parents. Reduces and stages the mesh files for '
    'AddComponentIdentity. No orientation or box is computed here: the '
    'server derives the frame.'
)

# CSC LIBRARY (decision 8.111) ----------------------------------------------
CSC_GH_MINIMUM = '261005'
LIBRARY_PROBLEM = None
try:
    import csc_gh
    csc_gh.require(CSC_GH_MINIMUM)
    from csc_gh.build import (BuildError, identity_body, loads_fragment, problems_of_identity, snapshot_body, staging_key, text)  # NOQA
    from csc_gh.rhino import (stage_geometry)  # NOQA
    from csc_gh.upload import (clear_staging, commit_staging, staging_root)  # NOQA
except ImportError:
    LIBRARY_PROBLEM = (
        'CSC library 261005 too old or missing: run CSC_Update, '
        'then restart Rhino')


DEFAULT_RGB = (110, 110, 110)

# OPTIONAL HELPERS: they never block the component (decisions 8.112, 8.113) ---
try:
    from csc_gh.ports import ensure_outputs
    from csc_gh.messages import set_state
except ImportError:
    ensure_outputs = set_state = None

OUTPUTS = [
    ('IdentityRequest', 'IdentityRequest',
     'Request JSON for AddComponentIdentity (IdentityCreateBody)'),
]


def empty_outputs():
    """What RunScript returns when it stops early."""
    if len(OUTPUTS) <= 1:
        return None
    return tuple(None for _ in OUTPUTS)


class CSC_CreateComponentIdentity(Grasshopper.Kernel.GH_ScriptInstance):
    """
    Author: Max Benjamin Eschenbach
    License: MIT License
    Version: 261005
    """

    _outputs_ready = True       # set by BeforeRunScript (8.112)
    _outputs_note = None

    def __init__(self):
        """Initialize this component and set component parameters."""
        super().__init__()
        self.Component = ghenv.Component  # NOQA
        self.InputParams = self.Component.Params.Input
        self.OutputParams = self.Component.Params.Output

    def _addRemark(self, msg: str = ''):
        rml = self.Component.RuntimeMessageLevel.Remark
        self.AddRuntimeMessage(rml, msg)

    def _addWarning(self, msg: str = ''):
        rml = self.Component.RuntimeMessageLevel.Warning
        self.AddRuntimeMessage(rml, msg)

    def _addError(self, msg: str = ''):
        rml = self.Component.RuntimeMessageLevel.Error
        self.AddRuntimeMessage(rml, msg)

    def _state(self, text=''):
        """The one short state under the component (decision 8.113)."""
        if set_state is not None:
            set_state(self.Component, text)

    def _stop(self):
        """True when RunScript has to return early: the library is missing or
        too old, or the outputs were just updated (says why)."""
        if LIBRARY_PROBLEM:
            self._addError(LIBRARY_PROBLEM)
            return True
        if self._outputs_note:
            self._addRemark(self._outputs_note)
        return not self._outputs_ready

    def _check_outputs(self):
        """Make the outputs match OUTPUTS before the script runs (8.112)."""
        self._outputs_ready, self._outputs_note = True, None
        if ensure_outputs is None:
            self._outputs_note = (
                'output check skipped: CSC library not installed')
            return
        status = ensure_outputs(self.Component, OUTPUTS)
        self._outputs_ready, self._outputs_note = status.ready, status.remark

    def BeforeRunScript(self):
        """Perform some setup actions."""
        self.InputParams[0].Description = (
            'Empty the staging folder of files waiting for an Add component'
        )
        self.InputParams[1].Description = (
            'Id of the component (the UUID of its tag; empty: the server makes '
            'one)'
        )
        self.InputParams[2].Description = (
            'Dataset the component belongs to (not inherited)'
        )
        self.InputParams[3].Description = (
            'IdentityMetadata JSON (original function, material, origin ...); '
            'leave empty for a cut piece: its parents give it'
        )
        self.InputParams[4].Description = (
            'SnapshotMetadata JSON (name, colour, location, notes ...)'
        )
        self.InputParams[5].Description = (
            'Capture JSON (how the geometry was recorded); optional'
        )
        self.InputParams[6].Description = (
            'Meshes, point clouds, extrusions (-> prism) and box-shaped breps '
            '(-> box). Meshes are reduced for the Preview and the Reduced '
            'level; the original is kept.'
        )
        self.InputParams[7].Description = (
            'Ids of the pieces this one is cut from (one parent: a split, '
            'several: a merge)'
        )
        self.InputParams[8].Description = (
            'Move the centroid of the geometry to the origin before it is '
            'stored (default false: stored coordinates are those you give)'
        )
        # Initialize output param descriptions
        self._check_outputs()
        if LIBRARY_PROBLEM is None:
            csc_gh.dev_reload(globals())

    def RunScript(self,
            ClearLocalStorage: bool,
            IdentityID: str,
            Dataset: str,
            Identity: str,
            Snapshot: str,
            Capture: str,
            Geometry: list[Rhino.Geometry.GeometryBase],
            ParentIdentity: list[object],
            Centre: bool):
        if self._stop():
            return empty_outputs()
        IdentityRequest = ''
        tmp_dir = None
        try:
            # ClearLocalStorage empties the staging folder and stops here
            if ClearLocalStorage:
                folder = clear_staging()
                self._state('Staging folder cleared')
                self._addRemark(f'Cleared {folder}')
                return IdentityRequest

            if not Geometry:
                raise BuildError('Input Geometry failed to collect data')
            root = staging_root()
            os.makedirs(root, exist_ok=True)
            tmp_dir = os.path.join(root, '_tmp_' + uuid.uuid4().hex)
            meta = loads_fragment(Snapshot, 'Snapshot') or {}
            geometry, mani, move = stage_geometry(
                list(Geometry), tmp_dir, meta.get('color') or DEFAULT_RGB,
                bool(Centre))
            snapshot_dict = snapshot_body(meta, geometry, Capture)
            body = identity_body(IdentityID, Dataset, Identity, snapshot_dict,
                                 list(ParentIdentity or []))
            if not text(IdentityID):
                self._addRemark('No IdentityID: the server will assign one')

            problems = problems_of_identity(body)
            if problems:
                raise BuildError('\n'.join(problems))
            text_json = json.dumps(body, sort_keys=True)
            key = staging_key(text_json)
            folder = commit_staging(tmp_dir, key, mani)
            tmp_dir = None
            IdentityRequest = text_json
            files = sum(len(v) for v in mani.get('meshes', {}).values()) \
                + len(mani.get('point_clouds', []))
            self._state('Request built' + (
                f' ({files} file(s) staged)' if files else ''))
            if any(move):
                self._addRemark(
                    'Centred: the geometry was moved by '
                    f'({move[0]:.3f}, {move[1]:.3f}, {move[2]:.3f})')
            if folder:
                self._addRemark(f'Staged files: {folder}')
            return IdentityRequest
        except BuildError as error:
            self._addError(str(error))
        except ValueError as error:
            self._addError(str(error))
        except Exception as error:
            msg = f'Unexpected error: {error}'
            self._addError(msg)
        finally:
            if tmp_dir and os.path.isdir(tmp_dir):
                import shutil
                shutil.rmtree(tmp_dir, ignore_errors=True)
        return IdentityRequest
# ---------- end createcomponentidentity ----------
identityrequest = Data(createcomponentidentity)

geometry_2 = Data(samplemeshgeometry)
computeframe = ComputeFrame(Geometry=geometry_2)  # -> Frame, Box, Extents, Transform, FrameJSON; inputs Geometry: list of GeometryBase, OriginalFunction: String
# ---------- computeframe: Python ----------
#! python3
# -*- coding: utf-8 -*-
# venv: DDU_CSC_MATCH
# r: charset_normalizer
# r: numpy==2.0.2
# r: scipy==1.13.1
# r: trimesh==4.12.2
# r: networkx==3.2.1
print('ENV OK!')

# PYTHON STANDARD LIBRARY IMPORTS ---------------------------------------------
import json  # NOQA

# RHINO AND GH RELATED IMPORTS ------------------------------------------------
import System  # NOQA
import Rhino  # NOQA
import Grasshopper  # NOQA

# GHENV COMPONENT SETTINGS ----------------------------------------------------
ghenv.Component.Name = 'ComputeFrame'  # NOQA
ghenv.Component.NickName = 'ComputeFrame'  # NOQA
ghenv.Component.Category = 'DDU_CSC'  # NOQA
ghenv.Component.SubCategory = '7 Geometry Tools'  # NOQA
ghenv.Component.Description = (  # NOQA
    'Computes the frame of a piece offline, with the rules of the server: '
    'the minimum-volume oriented box of its points, longest side along X, '
    'middle along Y, shortest along Z (an IfcColumn at least twice as long '
    'as wide stands), signs and ties chosen closest to the axes you give, '
    'never upside down. A piece gets the same frame here as in the catalog '
    '(tests keep the two in step).'
)

# CSC LIBRARY (decision 8.111) ----------------------------------------------
CSC_GH_MINIMUM = '261005'
LIBRARY_PROBLEM = None
try:
    import csc_gh
    csc_gh.require(CSC_GH_MINIMUM)
    from csc_gh.build import (BuildError, text)  # NOQA
    from csc_gh.frame import (compute_frame)  # NOQA
    from csc_gh.rhino import (canonical_transform, geometry_points, plane_from_frame)  # NOQA
except ImportError:
    LIBRARY_PROBLEM = (
        'CSC library 261005 too old or missing: run CSC_Update, '
        'then restart Rhino')

# OPTIONAL HELPERS: they never block the component (decisions 8.112, 8.113) ---
try:
    from csc_gh.ports import ensure_outputs
    from csc_gh.messages import set_state
except ImportError:
    ensure_outputs = set_state = None

OUTPUTS = [
    ('Frame', 'Frame',
     'The frame as a plane (centre of the box, axes x, y, z)'),
    ('Box', 'Box',
     'The oriented box of the piece'),
    ('Extents', 'Extents',
     'Extents of the box along X, Y and Z'),
    ('Transform', 'Transform',
     'Transform from the geometry as given to its canonical orientation (frame to world plane)'),
    ('FrameJSON', 'FrameJSON',
     'Frame JSON ({frame, bbx, version}), as the catalog stores it'),
]


def empty_outputs():
    """What RunScript returns when it stops early."""
    if len(OUTPUTS) <= 1:
        return None
    return tuple(None for _ in OUTPUTS)


class CSC_ComputeFrame(Grasshopper.Kernel.GH_ScriptInstance):
    """
    Author: Max Benjamin Eschenbach
    License: MIT License
    Version: 261005
    """

    _outputs_ready = True       # set by BeforeRunScript (8.112)
    _outputs_note = None

    def __init__(self):
        super().__init__()
        self.Component = ghenv.Component  # NOQA
        self.InputParams = self.Component.Params.Input
        self.OutputParams = self.Component.Params.Output

    def _addRemark(self, msg: str = ''):
        rml = self.Component.RuntimeMessageLevel.Remark
        self.AddRuntimeMessage(rml, msg)

    def _addWarning(self, msg: str = ''):
        rml = self.Component.RuntimeMessageLevel.Warning
        self.AddRuntimeMessage(rml, msg)

    def _addError(self, msg: str = ''):
        rml = self.Component.RuntimeMessageLevel.Error
        self.AddRuntimeMessage(rml, msg)

    def _state(self, text=''):
        """The one short state under the component (decision 8.113)."""
        if set_state is not None:
            set_state(self.Component, text)

    def _stop(self):
        """True when RunScript has to return early: the library is missing or
        too old, or the outputs were just updated (says why)."""
        if LIBRARY_PROBLEM:
            self._addError(LIBRARY_PROBLEM)
            return True
        if self._outputs_note:
            self._addRemark(self._outputs_note)
        return not self._outputs_ready

    def _check_outputs(self):
        """Make the outputs match OUTPUTS before the script runs (8.112)."""
        self._outputs_ready, self._outputs_note = True, None
        if ensure_outputs is None:
            self._outputs_note = (
                'output check skipped: CSC library not installed')
            return
        status = ensure_outputs(self.Component, OUTPUTS)
        self._outputs_ready, self._outputs_note = status.ready, status.remark

    def BeforeRunScript(self):
        """Perform some setup actions."""
        self.InputParams[0].Description = (
            'The geometry of one piece: meshes, point clouds, breps, '
            'extrusions (their vertices are used)'
        )
        self.InputParams[1].Description = (
            'Original function, e.g. IfcColumn (empty: not a column)'
        )
        self._check_outputs()
        if LIBRARY_PROBLEM is None:
            csc_gh.dev_reload(globals())

    def RunScript(self,
            Geometry: list[Rhino.Geometry.GeometryBase],
            OriginalFunction: str):
        if self._stop():
            return empty_outputs()
        Frame = None
        Box = None
        Extents = []
        Transform = None
        FrameJSON = ''
        try:
            items = [g for g in (Geometry or []) if g is not None]
            if not items:
                raise BuildError('Input Geometry failed to collect data')
            points = geometry_points(items)
            result = compute_frame(points, text(OriginalFunction))
            frame = result['frame']
            Frame = plane_from_frame(frame)
            sx, sy, sz = result['bbx']
            Box = Rhino.Geometry.Box(
                Frame, Rhino.Geometry.Interval(-sx / 2, sx / 2),
                Rhino.Geometry.Interval(-sy / 2, sy / 2),
                Rhino.Geometry.Interval(-sz / 2, sz / 2))
            Extents = [sx, sy, sz]
            Transform = canonical_transform(frame)
            FrameJSON = json.dumps({'frame': frame, 'bbx': list(result['bbx']),
                                    'version': result['version']})
        except BuildError as error:
            self._addError(str(error))
        except Exception as error:
            msg = f'Unexpected error: {error}'
            self._addError(msg)
        return Frame, Box, Extents, Transform, FrameJSON
# ---------- end computeframe ----------

# Step 3
# comments & notes: Finally, if CreateComponentIdentity runs without errors, we can submit the created Component to the Catalog!
# 
# Set the Toggle to True to execute the upload.
toggle = BooleanToggle(False)
identityrequest_2 = Data(identityrequest)
addcomponentidentity = AddComponentIdentity(IdentityRequest=identityrequest_2, Run=toggle)  # -> Created; inputs IdentityRequest: String, Run: Boolean
# ---------- addcomponentidentity: Python ----------
#! python3
# -*- coding: utf-8 -*-
# venv: DDU_CSC
# r: charset_normalizer
# r: requests==2.32.5
# r: numpy==2.0.2
print('ENV OK!')

# PYTHON STANDARD LIBRARY IMPORTS ---------------------------------------------
import json  # NOQA

# THIRD PARTY LIBRARY IMPORTS -------------------------------------------------
import requests  # NOQA

# RHINO AND GH RELATED IMPORTS ------------------------------------------------
import System  # NOQA
import Grasshopper  # NOQA
import Rhino  # NOQA
import scriptcontext as sc  # NOQA

# GHENV COMPONENT SETTINGS ----------------------------------------------------
ghenv.Component.Name = 'AddComponentIdentity'  # NOQA
ghenv.Component.NickName = 'AddComponentIdentity'  # NOQA
ghenv.Component.Category = 'DDU_CSC'  # NOQA
ghenv.Component.SubCategory = '2 Catalog Interface'  # NOQA
ghenv.Component.Description = (  # NOQA
    'Records a new component with its first state: POST /identities '
    'and uploads the files staged by CreateComponentIdentity; consumes a '
    'pending transmitted component ID. The state lands as a draft: complete '
    'it (files, checks) and submit it in the web, My work.'
)

# CSC LIBRARY (decision 8.111) ----------------------------------------------
CSC_GH_MINIMUM = '261008'
LIBRARY_PROBLEM = None
try:
    import csc_gh
    csc_gh.require(CSC_GH_MINIMUM)
    from csc_gh.build import (problems_of_identity, staging_key)  # NOQA
    from csc_gh.upload import (http_error_text, load_manifest, passport_after, staged_plan, staging_dir, upload_staged)  # NOQA
except ImportError:
    LIBRARY_PROBLEM = (
        'CSC library 261008 too old or missing: run CSC_Update, '
        'then restart Rhino')

# OPTIONAL HELPERS: they never block the component (decisions 8.112, 8.113) ---
try:
    from csc_gh.ports import ensure_outputs
    from csc_gh.messages import set_state
except ImportError:
    ensure_outputs = set_state = None

OUTPUTS = [
    ('Created', 'Created',
     'Component passport JSON ({identity, snapshots[]}) of the new component'),
]


def empty_outputs():
    """What RunScript returns when it stops early."""
    if len(OUTPUTS) <= 1:
        return None
    return tuple(None for _ in OUTPUTS)


class CSC_AddComponentIdentity(Grasshopper.Kernel.GH_ScriptInstance):
    """
    Author: Max Benjamin Eschenbach
    License: MIT License
    Version: 261008
    """

    _outputs_ready = True       # set by BeforeRunScript (8.112)
    _outputs_note = None

    def __init__(self):
        """Initialize this component and set component parameters."""
        super().__init__()
        self.Component = ghenv.Component  # NOQA
        self.InputParams = self.Component.Params.Input
        self.OutputParams = self.Component.Params.Output

    def _addRemark(self, msg: str = ''):
        rml = self.Component.RuntimeMessageLevel.Remark
        self.AddRuntimeMessage(rml, msg)

    def _addWarning(self, msg: str = ''):
        rml = self.Component.RuntimeMessageLevel.Warning
        self.AddRuntimeMessage(rml, msg)

    def _addError(self, msg: str = ''):
        rml = self.Component.RuntimeMessageLevel.Error
        self.AddRuntimeMessage(rml, msg)

    def _state(self, text=''):
        """The one short state under the component (decision 8.113)."""
        if set_state is not None:
            set_state(self.Component, text)

    def _stop(self):
        """True when RunScript has to return early: the library is missing or
        too old, or the outputs were just updated (says why)."""
        if LIBRARY_PROBLEM:
            self._addError(LIBRARY_PROBLEM)
            return True
        if self._outputs_note:
            self._addRemark(self._outputs_note)
        return not self._outputs_ready

    def _check_outputs(self):
        """Make the outputs match OUTPUTS before the script runs (8.112)."""
        self._outputs_ready, self._outputs_note = True, None
        if ensure_outputs is None:
            self._outputs_note = (
                'output check skipped: CSC library not installed')
            return
        status = ensure_outputs(self.Component, OUTPUTS)
        self._outputs_ready, self._outputs_note = status.ready, status.remark

    def BeforeRunScript(self):
        """Perform some setup actions."""
        self.InputParams[0].Description = (
            'Request JSON from CreateComponentIdentity'
        )
        self.InputParams[1].Description = (
            'Toggle to execute the create operation (the new state lands '
            'as a draft; submit it in the web)'
        )
        self._check_outputs()
        if LIBRARY_PROBLEM is None:
            csc_gh.dev_reload(globals())

    def get_auth_core_from_sticky(self):
        """Get AuthCore instance from sticky storage."""
        auth_core = sc.sticky.get('CSC_AuthCore')
        if auth_core is None:
            msg = ('No authentication found. Please use CSC_Session component '
                   'first.')
            self._addWarning(msg)
            return None
        return auth_core

    def consume_transmitted_id(self, auth_core, identity_id):
        """Consume a pending transmitted ID after the create; never fatal."""
        try:
            response = auth_core.authorized_post(
                '/component_id_transmission/consume',
                json_body={'identity_id': identity_id})
            if response.status_code == 200 and response.json().get(
                    'consumed', False):
                self._addRemark('Consumed pending transmitted ID.')
            elif response.status_code != 200:
                self._addWarning(
                    'Component created, but consuming the transmitted ID '
                    f'failed ({response.status_code}).')
        except Exception as error:
            self._addWarning('Component created, but consuming the '
                             f'transmitted ID failed: {error}')

    def RunScript(self, IdentityRequest: str, Run: bool):
        if self._stop():
            return empty_outputs()
        Created = Grasshopper.DataTree[System.Object]()

        auth_core = self.get_auth_core_from_sticky()
        if auth_core is None:
            return Created
        if not auth_core.is_valid():
            msg = ('Authentication expired. Please use CSC_Session '
                   'component to refresh.')
            self._addWarning(msg)
            return Created
        if not IdentityRequest:
            msg = 'Please provide the request JSON of CreateComponentIdentity.'
            self._addWarning(msg)
            return Created

        try:
            body = json.loads(IdentityRequest)
        except json.JSONDecodeError:
            msg = 'IdentityRequest must be valid JSON.'
            self._addError(msg)
            return Created
        problems = problems_of_identity(body)
        if problems:
            msg = 'The request is not a new-component request:\n' + \
                '\n'.join(problems)
            self._addError(msg)
            return Created

        directory = staging_dir(staging_key(IdentityRequest))
        manifest_dict = load_manifest(directory)
        pending, missing = ([], [])
        geometry = body['snapshot'].get('geometry', {})
        if manifest_dict:
            pending, missing = staged_plan(directory, manifest_dict)
        elif geometry.get('meshes') or geometry.get('point_clouds'):
            self._addRemark('No staged files for this request: only the '
                            'inline Preview geometry is stored.')
        if missing:
            self._addWarning('Staged files are missing: ' + ', '.join(
                entry['path'] for entry in missing))

        if not Run:
            self._state('Run is False')
            return Created

        try:
            response = auth_core.authorized_post('/identities',
                                                 json_body=body)
            if response.status_code != 201:
                msg = {
                    401: 'Authentication failed. Please sign in again.',
                    403: 'Access denied: you need the contributor role in '
                         'this dataset.',
                    409: 'A component with this IdentityID already exists.',
                }.get(response.status_code) or http_error_text(
                    response, 'Create')
                self._addError(msg)
                return Created
            created = response.json()
            identity_doc = created.get('identity') or {}
            snapshot_doc = created.get('snapshot') or {}
            identity_id = identity_doc.get('_id')
            snapshot_id = snapshot_doc.get('_id')
            self._addRemark(f'Created {identity_id} (state {snapshot_id}, '
                            'a draft)')
            self.consume_transmitted_id(auth_core, identity_id)

            upload_ok = True
            if pending:
                done, failed = upload_staged(
                    auth_core, snapshot_id, pending,
                    progress=self._state)
                for entry, reason in failed:
                    self._addWarning(reason)
                upload_ok = not failed
                self._addRemark(f'Uploaded {len(done)} of {len(pending)} '
                                'staged file(s).')

            if not upload_ok:
                self._addWarning('Some files failed to upload. The state is '
                                 'a draft: complete it in the web (My work) '
                                 'and submit it there.')
            self._state('draft')

            passport = passport_after(auth_core, identity_doc, snapshot_doc)
            Created.Add(json.dumps(passport),
                                   Grasshopper.Kernel.Data.GH_Path(0))
            return Created

        except requests.exceptions.ConnectionError as error:
            msg = 'Cannot connect to server. Please check your connection.'
            self._addError(msg + f'\nFull Error: {error}')
        except requests.exceptions.Timeout as error:
            msg = 'Request timeout. Server may be slow.'
            self._addError(msg + f'\nFull Error: {error}')
        except Exception as error:
            # includes CSCClientOutdated: its text names the fix
            self._addError(str(error))
        return Created
# ---------- end addcomponentidentity ----------
created = Data(addcomponentidentity)
