# Grasshopper definition DDU_CSC_GrasshopperInterface_Example_08.gh (Grasshopper 1.0.8)
# Copyright: 2025

# ---- group: __DDU_CSC_EXAMPLE_08__
# Step 1.1
latitude_longitude_string_i_e_from_googl = Panel("49.861254, 8.674743")  # "Latitude/Longitude String (i.e. from Google Maps)"
comments_notes = Panel("ExFeld Geolocation")
convertgeolocation = ConvertGeoLocation(LatLonString=latitude_longitude_string_i_e_from_googl)  # -> Lat, Lon, Vec; inputs LatLonString: String
# ---------- convertgeolocation: Python ----------
#! python3
# -*- coding: utf-8 -*-
# venv: DDU_CSC
print('ENV OK!')
# r: charset_normalizer
# r: requests

# RHINO AND GH RELATED IMPORTS ------------------------------------------------
import System  # NOQA
import Grasshopper  # NOQA
import Rhino  # NOQA
import scriptcontext as sc  # NOQA

# GHENV COMPONENT SETTINGS ----------------------------------------------------
ghenv.Component.Name = 'ConvertGeoLocation'  # NOQA
ghenv.Component.NickName = 'ConvertGeoLocation'  # NOQA
ghenv.Component.Category = 'DDU_CSC'  # NOQA
ghenv.Component.SubCategory = '6 Data Tools'  # NOQA
ghenv.Component.Description = (  # NOQA
    'Converts a latitude, longitude string (i.e. from Google Maps) '
    'to its individual components. Example input: "12.1231321, 9.1231231312" '
    'Returns the location as individual numbers and as vector.'
)

# OPTIONAL HELPERS: they never block the component (decisions 8.112, 8.113) ---
try:
    from csc_gh.ports import ensure_outputs
    from csc_gh.messages import set_state
except ImportError:
    ensure_outputs = set_state = None

OUTPUTS = [
    ('Lat', 'Lat',
     'Latitude component of the input string as float.'),
    ('Lon', 'Lon',
     'Longitude component of the input string as float.'),
    ('Vec', 'Vec',
     'Vector with lat/lon as X/Y.'),
]


def empty_outputs():
    """What RunScript returns when it stops early."""
    if len(OUTPUTS) <= 1:
        return None
    return tuple(None for _ in OUTPUTS)


class CSC_ConvertGeoLocation(Grasshopper.Kernel.GH_ScriptInstance):
    """
    Author: Max Benjamin Eschenbach
    License: MIT License
    Version: 261005
    """

    _outputs_ready = True       # set by BeforeRunScript (8.112)
    _outputs_note = None

    def __init__(self):
        """Initialize this component and set component parameters."""
        super().__init__()
        # initialize props
        self.Component = ghenv.Component  # NOQA
        self.InputParams = self.Component.Params.Input
        self.OutputParams = self.Component.Params.Output

    def _addRemark(self, msg: str = ''):
        """Add a remark message to the component."""
        rml = self.Component.RuntimeMessageLevel.Remark
        self.AddRuntimeMessage(rml, msg)

    def _addWarning(self, msg: str = ''):
        """Add a warning message to the component."""
        rml = self.Component.RuntimeMessageLevel.Warning
        self.AddRuntimeMessage(rml, msg)

    def _addError(self, msg: str = ''):
        """Add an error message to the component."""
        rml = self.Component.RuntimeMessageLevel.Error
        self.AddRuntimeMessage(rml, msg)

    def _state(self, text=''):
        """The one short state under the component (decision 8.113)."""
        if set_state is not None:
            set_state(self.Component, text)

    def _stop(self):
        """True when RunScript has to return early: the outputs were just
        updated (says why)."""
        if self._outputs_note:
            self._addRemark(self._outputs_note)
        return not self._outputs_ready

    def _check_outputs(self):
        """Make the outputs match OUTPUTS before the script runs (8.112)."""
        self._outputs_ready, self._outputs_note = True, None
        if ensure_outputs is None:
            self._outputs_note = (
                'output check skipped: CSC library not installed')
            return
        status = ensure_outputs(self.Component, OUTPUTS)
        self._outputs_ready, self._outputs_note = status.ready, status.remark

    def BeforeRunScript(self):
        """Perform some setup actions."""
        # Initialize input param descriptions
        self.InputParams[0].Description = (
            'Latitude, Longitude string, e.g. "12.1231321, 9.1231231312" '
        )
        # Initialize output param descriptions
        self._check_outputs()

    def RunScript(self, LatLonString: str):
        if self._stop():
            return empty_outputs()
        Lat = Grasshopper.DataTree[object]()
        Lon = Grasshopper.DataTree[object]()
        Vec = Grasshopper.DataTree[object]()
        _Results = [Lat, Lon, Vec]
        if not LatLonString:
            msg = 'Parameter LatLonString failed to collect data!'
            self._addWarning(msg)
            return _Results
        parts = LatLonString.split(',')
        if len(parts) > 2:
            msg = f'Splitting of Lat/Lon string failed! Raw result is {parts}...'
            self._addError(msg)
            return _Results
        Lat = float(parts[0].strip())
        Lon = float(parts[1].strip())
        Vec = Rhino.Geometry.Vector3d(Lat, Lon, 0)
        _Results = [Lat, Lon, Vec]
        return _Results
# ---------- end convertgeolocation ----------
location = Data(convertgeolocation.Vec)

smallrubble = Panel("f69f1858-e132-49cc-9474-416947ea797b")
smallrubble_2 = Mesh(<mesh referenced from the Rhino model>)

# __DEVELOPMENT_CREDITS__: Authors: Max Benjamin Eschenbach
# Constributors: Alessandro Garruto
# 
# Digital Design Unit (DDU)
# Prof. Dr.-Ing. Oliver Tessmann
# Fachbereich Architektur
# Technical University of Darmstadt
# 
# CREDITS:
# ------------
# Please see: https://2ndchances.build/credits
# Example 08:
# - Creating a new snapshot for an existing identity in the catalog
bigrubble = Panel("243df186-9e30-4b19-95aa-17d7d88976f9")
bigrubble_2 = Mesh(<mesh referenced from the Rhino model>)

steelfixture = Panel("7ebdd53b-27e4-4098-a3e5-f000790fd7c5")
steelfixture_2 = Mesh(<mesh referenced from the Rhino model>)

component_name = Panel("Schoenes Neues Feld 03")
fragment = BooleanToggle(True)
color = ColourSwatch(SwatchColor=RGB(189, 189, 189))
location_2 = Data(location)
snapshotmetadata = SnapshotMetadata(Name=component_name, Fragment=fragment, Color=color, Location=location_2)  # -> SnapshotMetadata; inputs Name: String, Fragment: Boolean, Quantity: Int32, Color: Color, Location: Vector3d, Notes: String, EffectiveFrom: String, ShapeClass: String, Complexity: Int32, EffectiveFromPrecision: String
# ---------- snapshotmetadata: Python ----------
#! python3
# -*- coding: utf-8 -*-
# venv: DDU_CSC
# r: charset_normalizer
# r: numpy==2.0.2
print('ENV OK!')

# PYTHON STANDARD LIBRARY IMPORTS ---------------------------------------------
import json  # NOQA

# RHINO AND GH RELATED IMPORTS ------------------------------------------------
import System  # NOQA
import Rhino  # NOQA
import Grasshopper  # NOQA

# GHENV COMPONENT SETTINGS ----------------------------------------------------
ghenv.Component.Name = 'SnapshotMetadata'  # NOQA
ghenv.Component.NickName = 'SnapshotMetadata'  # NOQA
ghenv.Component.Category = 'DDU_CSC'  # NOQA
ghenv.Component.SubCategory = '3 Component Operations'  # NOQA
ghenv.Component.Description = (  # NOQA
    'Builds the fields of one recorded state (name, fragment, quantity, '
    'colour, location, notes, start date) as JSON for '
    'CreateComponentSnapshot / CreateComponentIdentity. Shape class and '
    'complexity are derived by the server; set them only to override.'
)

# CSC LIBRARY (decision 8.111) ----------------------------------------------
CSC_GH_MINIMUM = '261005'
LIBRARY_PROBLEM = None
try:
    import csc_gh
    csc_gh.require(CSC_GH_MINIMUM)
    from csc_gh.build import (BuildError, snapshot_metadata)  # NOQA
except ImportError:
    LIBRARY_PROBLEM = (
        'CSC library 261005 too old or missing: run CSC_Update, '
        'then restart Rhino')

# OPTIONAL HELPERS: they never block the component (decisions 8.112, 8.113) ---
try:
    from csc_gh.ports import ensure_outputs
    from csc_gh.messages import set_state
except ImportError:
    ensure_outputs = set_state = None

OUTPUTS = [
    ('SnapshotMetadata', 'SnapshotMetadata',
     'SnapshotMetadata JSON (a fragment of the API payload)'),
]


def empty_outputs():
    """What RunScript returns when it stops early."""
    if len(OUTPUTS) <= 1:
        return None
    return tuple(None for _ in OUTPUTS)


class CSC_SnapshotMetadata(Grasshopper.Kernel.GH_ScriptInstance):
    """
    Author: Max Benjamin Eschenbach
    License: MIT License
    Version: 261005
    """

    _outputs_ready = True       # set by BeforeRunScript (8.112)
    _outputs_note = None

    def __init__(self):
        """Initialize this component and set component parameters."""
        super().__init__()
        self.Component = ghenv.Component  # NOQA
        self.InputParams = self.Component.Params.Input
        self.OutputParams = self.Component.Params.Output

    def _addRemark(self, msg: str = ''):
        rml = self.Component.RuntimeMessageLevel.Remark
        self.AddRuntimeMessage(rml, msg)

    def _addWarning(self, msg: str = ''):
        rml = self.Component.RuntimeMessageLevel.Warning
        self.AddRuntimeMessage(rml, msg)

    def _addError(self, msg: str = ''):
        rml = self.Component.RuntimeMessageLevel.Error
        self.AddRuntimeMessage(rml, msg)

    def _state(self, text=''):
        """The one short state under the component (decision 8.113)."""
        if set_state is not None:
            set_state(self.Component, text)

    def _stop(self):
        """True when RunScript has to return early: the library is missing or
        too old, or the outputs were just updated (says why)."""
        if LIBRARY_PROBLEM:
            self._addError(LIBRARY_PROBLEM)
            return True
        if self._outputs_note:
            self._addRemark(self._outputs_note)
        return not self._outputs_ready

    def _check_outputs(self):
        """Make the outputs match OUTPUTS before the script runs (8.112)."""
        self._outputs_ready, self._outputs_note = True, None
        if ensure_outputs is None:
            self._outputs_note = (
                'output check skipped: CSC library not installed')
            return
        status = ensure_outputs(self.Component, OUTPUTS)
        self._outputs_ready, self._outputs_note = status.ready, status.remark

    def BeforeRunScript(self):
        """Perform some setup actions."""
        self.InputParams[0].Description = (
            'Name of the component (empty: its catalog number)'
        )
        self.InputParams[1].Description = (
            'The piece is a fragment of a bigger one'
        )
        self.InputParams[2].Description = (
            'Number of identical pieces (default 1)'
        )
        self.InputParams[3].Description = (
            'Colour of the piece'
        )
        self.InputParams[4].Description = (
            'Latitude (X) and longitude (Y)'
        )
        self.InputParams[5].Description = (
            'Free text (up to 5000 characters)'
        )
        self.InputParams[6].Description = (
            'When this state started (empty: now; 2024-05-03, ...)'
        )
        self.InputParams[7].Description = (
            'Override: linear, planar, block, irregular or composite'
        )
        self.InputParams[8].Description = (
            'Override: 0 to 3'
        )
        self.InputParams[9].Description = (
            'exact, day, month, year or unknown (empty: from '
            'EffectiveFrom)'
        )
        # Initialize output param descriptions
        self._check_outputs()
        if LIBRARY_PROBLEM is None:
            csc_gh.dev_reload(globals())

    def RunScript(self,
            Name: str,
            Fragment: bool,
            Quantity: int,
            Color: System.Drawing.Color,
            Location: Rhino.Geometry.Vector3d,
            Notes: str,
            EffectiveFrom: str,
            ShapeClass: str,
            Complexity: int,
            EffectiveFromPrecision: str):
        if self._stop():
            return empty_outputs()
        SnapshotMetadata = ''
        if not EffectiveFromPrecision or EffectiveFromPrecision == '':
            EffectiveFromPrecision = None
        try:
            rgb_value = None
            if Color is not None:
                rgb_value = [Color.R, Color.G, Color.B]
            lat = lon = None
            if Location is not None:
                lat, lon = Location.X, Location.Y
            fragment = snapshot_metadata(
                Name, Fragment, Quantity, rgb_value, lat, lon, Notes, EffectiveFrom,
                EffectiveFromPrecision, ShapeClass, Complexity)
            SnapshotMetadata = json.dumps(fragment)
            return SnapshotMetadata
        except BuildError as error:
            self._addError(str(error))
        except Exception as error:
            msg = f'Unexpected error: {error}'
            self._addError(msg)
        return SnapshotMetadata
# ---------- end snapshotmetadata ----------
snapshotmetadata_2 = Data(snapshotmetadata)

# Step 2
# comments & notes: Here we create a new component identity (locally).
# 
# Most of the fields are already pre-set for you.
# You need to adjust:
# - Name
# - Dataset
# - Color
# - Parent Identity ID if applicable(Important!)
clearlocalstorage = Button()
identityid = Data(steelfixture)
geometry = Data(steelfixture_2)
snapshotmetadata_3 = Data(snapshotmetadata_2)
createcomponentsnapshot = CreateComponentSnapshot(
    ClearLocalStorage=clearlocalstorage,
    IdentityID=identityid,
    Snapshot=snapshotmetadata_3,
    Geometry=geometry,
    Centre=Toggle(False))  # -> SnapshotRequest; inputs ClearLocalStorage: Boolean, IdentityID: String, Snapshot: String, Capture: String, Geometry: list of GeometryBase, Supersedes: String, Centre: Boolean
# ---------- createcomponentsnapshot: Python ----------
#! python3
# -*- coding: utf-8 -*-
# venv: DDU_CSC
# r: charset_normalizer
# r: numpy==2.0.2
print('ENV OK!')

# PYTHON STANDARD LIBRARY IMPORTS ---------------------------------------------
import json  # NOQA
import os  # NOQA
import uuid  # NOQA

# RHINO AND GH RELATED IMPORTS ------------------------------------------------
import System  # NOQA
import Rhino  # NOQA
import Grasshopper  # NOQA

# GHENV COMPONENT SETTINGS ----------------------------------------------------
ghenv.Component.Name = 'CreateComponentSnapshot'  # NOQA
ghenv.Component.NickName = 'CreateComponentSnapshot'  # NOQA
ghenv.Component.Category = 'DDU_CSC'  # NOQA
ghenv.Component.SubCategory = '3 Component Operations'  # NOQA
ghenv.Component.Description = (  # NOQA
    'Builds the request that records a new state of an existing '
    'component (POST /identities/{id}/snapshots) or, with Supersedes, a '
    'correction of a published state with its new scan (POST '
    '/snapshots/{id}/supersede): the builder objects (SnapshotMetadata, '
    'Capture) and the geometry. Reduces and stages the mesh files for '
    'AddComponentSnapshot. The frame is derived by the server.'
)

# CSC LIBRARY (decision 8.111) ----------------------------------------------
CSC_GH_MINIMUM = '261005'
LIBRARY_PROBLEM = None
try:
    import csc_gh
    csc_gh.require(CSC_GH_MINIMUM)
    from csc_gh.build import (BuildError, loads_fragment, problems_of_envelope, snapshot_body, snapshot_envelope, staging_key)  # NOQA
    from csc_gh.rhino import (stage_geometry)  # NOQA
    from csc_gh.upload import (clear_staging, commit_staging, staging_root)  # NOQA
except ImportError:
    LIBRARY_PROBLEM = (
        'CSC library 261005 too old or missing: run CSC_Update, '
        'then restart Rhino')


DEFAULT_RGB = (110, 110, 110)

# OPTIONAL HELPERS: they never block the component (decisions 8.112, 8.113) ---
try:
    from csc_gh.ports import ensure_outputs
    from csc_gh.messages import set_state
except ImportError:
    ensure_outputs = set_state = None

OUTPUTS = [
    ('SnapshotRequest', 'SnapshotRequest',
     'Request JSON for AddComponentSnapshot (the state and where it goes)'),
]


def empty_outputs():
    """What RunScript returns when it stops early."""
    if len(OUTPUTS) <= 1:
        return None
    return tuple(None for _ in OUTPUTS)


class CSC_CreateComponentSnapshot(Grasshopper.Kernel.GH_ScriptInstance):
    """
    Author: Max Benjamin Eschenbach
    License: MIT License
    Version: 261005
    """

    _outputs_ready = True       # set by BeforeRunScript (8.112)
    _outputs_note = None

    def __init__(self):
        """Initialize this component and set component parameters."""
        super().__init__()
        self.Component = ghenv.Component  # NOQA
        self.InputParams = self.Component.Params.Input
        self.OutputParams = self.Component.Params.Output

    def _addRemark(self, msg: str = ''):
        rml = self.Component.RuntimeMessageLevel.Remark
        self.AddRuntimeMessage(rml, msg)

    def _addWarning(self, msg: str = ''):
        rml = self.Component.RuntimeMessageLevel.Warning
        self.AddRuntimeMessage(rml, msg)

    def _addError(self, msg: str = ''):
        rml = self.Component.RuntimeMessageLevel.Error
        self.AddRuntimeMessage(rml, msg)

    def _state(self, text=''):
        """The one short state under the component (decision 8.113)."""
        if set_state is not None:
            set_state(self.Component, text)

    def _stop(self):
        """True when RunScript has to return early: the library is missing or
        too old, or the outputs were just updated (says why)."""
        if LIBRARY_PROBLEM:
            self._addError(LIBRARY_PROBLEM)
            return True
        if self._outputs_note:
            self._addRemark(self._outputs_note)
        return not self._outputs_ready

    def _check_outputs(self):
        """Make the outputs match OUTPUTS before the script runs (8.112)."""
        self._outputs_ready, self._outputs_note = True, None
        if ensure_outputs is None:
            self._outputs_note = (
                'output check skipped: CSC library not installed')
            return
        status = ensure_outputs(self.Component, OUTPUTS)
        self._outputs_ready, self._outputs_note = status.ready, status.remark

    def BeforeRunScript(self):
        """Perform some setup actions."""
        self.InputParams[0].Description = (
            'Empty the staging folder of files waiting for an Add component'
        )
        self.InputParams[1].Description = (
            'Id of the component'
        )
        self.InputParams[2].Description = (
            'SnapshotMetadata JSON (name, colour, location, notes ...)'
        )
        self.InputParams[3].Description = (
            'Capture JSON (how the geometry was recorded); optional'
        )
        self.InputParams[4].Description = (
            'Meshes, point clouds, extrusions (-> prism) and box-shaped breps '
            '(-> box). Meshes are reduced for the Preview and the Reduced '
            'level; the original is kept.'
        )
        self.InputParams[5].Description = (
            'Id of the published state this one corrects (empty: a new state)'
        )
        self.InputParams[6].Description = (
            'Move the centroid of the geometry to the origin before it is '
            'stored (default false: stored coordinates are those you give)'
        )
        # Initialize output param descriptions
        self._check_outputs()
        if LIBRARY_PROBLEM is None:
            csc_gh.dev_reload(globals())

    def RunScript(self,
            ClearLocalStorage: bool,
            IdentityID: str,
            Snapshot: str,
            Capture: str,
            Geometry: list[Rhino.Geometry.GeometryBase],
            Supersedes: str,
            Centre: bool):
        if self._stop():
            return empty_outputs()
        SnapshotRequest = ''
        tmp_dir = None
        try:
            # ClearLocalStorage empties the staging folder and stops here
            if ClearLocalStorage:
                folder = clear_staging()
                self._state('Staging folder cleared')
                self._addRemark(f'Cleared {folder}')
                return SnapshotRequest

            if not Geometry:
                raise BuildError('Input Geometry failed to collect data')
            root = staging_root()
            os.makedirs(root, exist_ok=True)
            tmp_dir = os.path.join(root, '_tmp_' + uuid.uuid4().hex)
            meta = loads_fragment(Snapshot, 'Snapshot') or {}
            geometry, mani, move = stage_geometry(
                list(Geometry), tmp_dir, meta.get('color') or DEFAULT_RGB,
                bool(Centre))
            snapshot_dict = snapshot_body(meta, geometry, Capture)
            body = snapshot_envelope(IdentityID, snapshot_dict, Supersedes)

            problems = problems_of_envelope(body)
            if problems:
                raise BuildError('\n'.join(problems))
            text_json = json.dumps(body, sort_keys=True)
            key = staging_key(text_json)
            folder = commit_staging(tmp_dir, key, mani)
            tmp_dir = None
            SnapshotRequest = text_json
            files = sum(len(v) for v in mani.get('meshes', {}).values()) \
                + len(mani.get('point_clouds', []))
            self._state('Request built' + (
                f' ({files} file(s) staged)' if files else ''))
            if any(move):
                self._addRemark(
                    'Centred: the geometry was moved by '
                    f'({move[0]:.3f}, {move[1]:.3f}, {move[2]:.3f})')
            if folder:
                self._addRemark(f'Staged files: {folder}')
            return SnapshotRequest
        except BuildError as error:
            self._addError(str(error))
        except ValueError as error:
            self._addError(str(error))
        except Exception as error:
            msg = f'Unexpected error: {error}'
            self._addError(msg)
        finally:
            if tmp_dir and os.path.isdir(tmp_dir):
                import shutil
                shutil.rmtree(tmp_dir, ignore_errors=True)
        return SnapshotRequest
# ---------- end createcomponentsnapshot ----------
snapshotrequest = Data(createcomponentsnapshot)

snapshotrequest_2 = Data(snapshotrequest)
addcomponentsnapshot = AddComponentSnapshot(SnapshotRequest=snapshotrequest_2, Run=Toggle(False))  # -> Created; inputs SnapshotRequest: String, Supersedes: String, Run: Boolean
# ---------- addcomponentsnapshot: Python ----------
#! python3
# -*- coding: utf-8 -*-
# venv: DDU_CSC
# r: charset_normalizer
# r: requests==2.32.5
# r: numpy==2.0.2
print('ENV OK!')

# PYTHON STANDARD LIBRARY IMPORTS ---------------------------------------------
import json  # NOQA

# THIRD PARTY LIBRARY IMPORTS -------------------------------------------------
import requests  # NOQA

# RHINO AND GH RELATED IMPORTS ------------------------------------------------
import System  # NOQA
import Grasshopper  # NOQA
import Rhino  # NOQA
import scriptcontext as sc  # NOQA

# GHENV COMPONENT SETTINGS ----------------------------------------------------
ghenv.Component.Name = 'AddComponentSnapshot'  # NOQA
ghenv.Component.NickName = 'AddComponentSnapshot'  # NOQA
ghenv.Component.Category = 'DDU_CSC'  # NOQA
ghenv.Component.SubCategory = '2 Catalog Interface'  # NOQA
ghenv.Component.Description = (  # NOQA
    'Records a new state of an existing component '
    '(POST /identities/{id}/snapshots) or, with Supersedes, a correction '
    'of a published state with its new scan (POST /snapshots/{id}/supersede), '
    'then uploads the files staged by CreateComponentSnapshot. The state '
    'lands as a draft: complete it (files, checks) and submit it in the web, '
    'My work.'
)

# CSC LIBRARY (decision 8.111) ----------------------------------------------
CSC_GH_MINIMUM = '261008'
LIBRARY_PROBLEM = None
try:
    import csc_gh
    csc_gh.require(CSC_GH_MINIMUM)
    from csc_gh.build import (is_uuid, problems_of_envelope, staging_key, text)  # NOQA
    from csc_gh.upload import (http_error_text, load_manifest, passport_after, staged_plan, staging_dir, upload_staged)  # NOQA
except ImportError:
    LIBRARY_PROBLEM = (
        'CSC library 261008 too old or missing: run CSC_Update, '
        'then restart Rhino')

# OPTIONAL HELPERS: they never block the component (decisions 8.112, 8.113) ---
try:
    from csc_gh.ports import ensure_outputs
    from csc_gh.messages import set_state
except ImportError:
    ensure_outputs = set_state = None

OUTPUTS = [
    ('Created', 'Created',
     'Component passport JSON ({identity, snapshots[]}) with the new state'),
]


def empty_outputs():
    """What RunScript returns when it stops early."""
    if len(OUTPUTS) <= 1:
        return None
    return tuple(None for _ in OUTPUTS)


class CSC_AddComponentSnapshot(Grasshopper.Kernel.GH_ScriptInstance):
    """
    Author: Max Benjamin Eschenbach
    License: MIT License
    Version: 261008
    """

    _outputs_ready = True       # set by BeforeRunScript (8.112)
    _outputs_note = None

    def __init__(self):
        super().__init__()
        self.Component = ghenv.Component  # NOQA
        self.InputParams = self.Component.Params.Input
        self.OutputParams = self.Component.Params.Output

    def _addRemark(self, msg: str = ''):
        rml = self.Component.RuntimeMessageLevel.Remark
        self.AddRuntimeMessage(rml, msg)

    def _addWarning(self, msg: str = ''):
        rml = self.Component.RuntimeMessageLevel.Warning
        self.AddRuntimeMessage(rml, msg)

    def _addError(self, msg: str = ''):
        rml = self.Component.RuntimeMessageLevel.Error
        self.AddRuntimeMessage(rml, msg)

    def _state(self, text=''):
        """The one short state under the component (decision 8.113)."""
        if set_state is not None:
            set_state(self.Component, text)

    def _stop(self):
        """True when RunScript has to return early: the library is missing or
        too old, or the outputs were just updated (says why)."""
        if LIBRARY_PROBLEM:
            self._addError(LIBRARY_PROBLEM)
            return True
        if self._outputs_note:
            self._addRemark(self._outputs_note)
        return not self._outputs_ready

    def _check_outputs(self):
        """Make the outputs match OUTPUTS before the script runs (8.112)."""
        self._outputs_ready, self._outputs_note = True, None
        if ensure_outputs is None:
            self._outputs_note = (
                'output check skipped: CSC library not installed')
            return
        status = ensure_outputs(self.Component, OUTPUTS)
        self._outputs_ready, self._outputs_note = status.ready, status.remark

    def BeforeRunScript(self):
        """Perform some setup actions."""
        self.InputParams[0].Description = (
            'Request JSON from CreateComponentSnapshot'
        )
        self.InputParams[1].Description = (
            'Id of the published state this one corrects (overrides the '
            'one in the request; empty: a new state)'
        )
        self.InputParams[2].Description = (
            'Toggle to execute the create operation (the new state lands '
            'as a draft; submit it in the web)'
        )
        self._check_outputs()
        if LIBRARY_PROBLEM is None:
            csc_gh.dev_reload(globals())

    def get_auth_core_from_sticky(self):
        """Get AuthCore instance from sticky storage."""
        auth_core = sc.sticky.get('CSC_AuthCore')
        if auth_core is None:
            msg = ('No authentication found. Please use CSC_Session component '
                   'first.')
            self._addWarning(msg)
            return None
        return auth_core

    def RunScript(self, SnapshotRequest: str, Supersedes: str, Run: bool):
        if self._stop():
            return empty_outputs()
        Created = Grasshopper.DataTree[System.Object]()

        auth_core = self.get_auth_core_from_sticky()
        if auth_core is None:
            return Created
        if not auth_core.is_valid():
            msg = ('Authentication expired. Please use CSC_Session '
                   'component to refresh.')
            self._addWarning(msg)
            return Created
        if not SnapshotRequest:
            msg = 'Please provide the request JSON of CreateComponentSnapshot.'
            self._addWarning(msg)
            return Created

        try:
            envelope = json.loads(SnapshotRequest)
        except json.JSONDecodeError:
            msg = 'SnapshotRequest must be valid JSON.'
            self._addError(msg)
            return Created
        problems = problems_of_envelope(envelope)
        if problems:
            msg = 'The request is not a snapshot request:\n' + \
                '\n'.join(problems)
            self._addError(msg)
            return Created

        identity_id = envelope['identity_id']
        supersedes = text(Supersedes) or envelope.get('supersedes')
        if supersedes and not is_uuid(supersedes):
            msg = 'Supersedes is not a valid snapshot UUID.'
            self._addError(msg)
            return Created
        body = envelope['snapshot']

        directory = staging_dir(staging_key(SnapshotRequest))
        manifest_dict = load_manifest(directory)
        pending, missing = ([], [])
        geometry = body.get('geometry', {})
        if manifest_dict:
            pending, missing = staged_plan(directory, manifest_dict)
        elif geometry.get('meshes') or geometry.get('point_clouds'):
            self._addRemark('No staged files for this request: only the '
                            'inline Preview geometry is stored.')
        if missing:
            self._addWarning('Staged files are missing: ' + ', '.join(
                entry['path'] for entry in missing))

        if not Run:
            self._state('Run is False')
            return Created

        try:
            if supersedes:
                path = f'/snapshots/{supersedes}/supersede'
            else:
                path = f'/identities/{identity_id}/snapshots'
            response = auth_core.authorized_post(path, json_body=body)
            if response.status_code != 201:
                msg = {
                    401: 'Authentication failed. Please sign in again.',
                    403: 'Access denied: you need the contributor role in '
                         'this dataset.',
                    404: 'Component or state not found.',
                }.get(response.status_code) or http_error_text(
                    response, 'Create')
                self._addError(msg)
                return Created
            snapshot_doc = response.json()
            snapshot_id = snapshot_doc.get('_id')
            self._addRemark(
                f'Created state {snapshot_id} (version '
                f'{snapshot_doc.get("version")}, a draft)')

            upload_ok = True
            if pending:
                done, failed = upload_staged(
                    auth_core, snapshot_id, pending,
                    progress=self._state)
                for entry, reason in failed:
                    self._addWarning(reason)
                upload_ok = not failed
                self._addRemark(f'Uploaded {len(done)} of {len(pending)} '
                                'staged file(s).')

            if not upload_ok:
                self._addWarning('Some files failed to upload. The state is '
                                 'a draft: complete it in the web (My work) '
                                 'and submit it there.')
            self._state('draft')

            passport = passport_after(auth_core, {'_id': identity_id},
                                      snapshot_doc)
            Created.Add(json.dumps(passport),
                                  Grasshopper.Kernel.Data.GH_Path(0))
            return Created

        except requests.exceptions.ConnectionError as error:
            msg = 'Cannot connect to server. Please check your connection.'
            self._addError(msg + f'\nFull Error: {error}')
        except requests.exceptions.Timeout as error:
            msg = 'Request timeout. Server may be slow.'
            self._addError(msg + f'\nFull Error: {error}')
        except Exception as error:
            # includes CSCClientOutdated: its text names the fix
            self._addError(str(error))
        return Created
# ---------- end addcomponentsnapshot ----------
created = Data(addcomponentsnapshot)
